# Dynamo graph Mur_DWG-v3.dyn (Dynamo 4.1.1.5050)
# author: CHU_BDX
# Attention : Veuillez changer l'unité du projet en MILIMETRES avant d'exécuter le script.

# group: Entrées
n1_plan_dwg = DSModelElementSelection()  # "1.Plan DWG"; 1 picked in the model; graph input
n2_calque_mur = StringInput("CO- Mur")  # "2.Calque Mur"; graph input
n4_largeur_maxi_mur_mm = DoubleInput(150)  # "4.Largeur Maxi Mur (mm)"; graph input
n3_calque_porte = StringInput("CO- Porte")  # "3.Calque Porte"; graph input
n5_wall_types = WallTypes("Générique - Int. 70 mm")  # "5.Wall Types"; graph input
n6_niveau_bas = Levels("Niveau 0")  # "6.Niveau Bas"; graph input
n7_niveau_haut = Levels("Niveau 1")  # "7.Niveau Haut"; graph input

curvesFromCADLayers = CAD.CurvesFromCADLayers(importInstance=n1_plan_dwg, layerNames=n2_calque_mur)
code_block = CodeBlock { 10; 1; }
MUR_01_NettoyerCourbes = Python(IN[0]=curvesFromCADLayers.Curve, IN[1]=code_block.out0, IN[2]=code_block.out1)  # PythonNet3
# ---------- MUR_01_NettoyerCourbes.python (286 lines) ----------
# -*- coding: utf-8 -*-

import clr

clr.AddReference("ProtoGeometry")
from Autodesk.DesignScript.Geometry import Line

clr.AddReference("RevitAPI")
from Autodesk.Revit.DB import UnitUtils, UnitTypeId, SpecTypeId

clr.AddReference("RevitServices")
from RevitServices.Persistence import DocumentManager


# ============================================================
# INPUTS
# ============================================================

curves_input = IN[0]

# Valeurs saisies en mm
min_length_mm = float(IN[1]) if IN[1] is not None else 10.0
tolerance_mm = float(IN[2]) if IN[2] is not None else 1.0


# ============================================================
# DOCUMENT REVIT + UNITES
# ============================================================

doc = DocumentManager.Instance.CurrentDBDocument

project_unit_id = (
    doc.GetUnits()
       .GetFormatOptions(SpecTypeId.Length)
       .GetUnitTypeId()
)


def mm_to_project_units(value_mm):
    """
    Convertit une valeur en mm vers l'unité de longueur
    actuellement utilisée dans le projet Revit.
    """

    internal_value = UnitUtils.ConvertToInternalUnits(
        value_mm,
        UnitTypeId.Millimeters
    )

    return UnitUtils.ConvertFromInternalUnits(
        internal_value,
        project_unit_id
    )


min_length = mm_to_project_units(min_length_mm)
tolerance = mm_to_project_units(tolerance_mm)


# ============================================================
# FLATTEN
# ============================================================

def flatten(data):
    """
    Aplatissement récursif des listes.
    """

    result = []

    if data is None:
        return result

    if isinstance(data, (list, tuple)):

        for item in data:
            result.extend(flatten(item))

    else:

        result.append(data)

    return result


all_curves = flatten(curves_input)


# ============================================================
# CONSERVER UNIQUEMENT LES LIGNES
# ============================================================

lines = []

for curve in all_curves:

    if curve is None:
        continue

    # Une ligne DesignScript possède notamment StartPoint,
    # EndPoint et Direction.
    if (
        hasattr(curve, "StartPoint")
        and hasattr(curve, "EndPoint")
        and hasattr(curve, "Direction")
    ):
        lines.append(curve)


initial_line_count = len(lines)


# ============================================================
# NORMALISER LE SENS DES LIGNES
# ============================================================

def normalize_line(line):
    """
    Impose un sens identique aux lignes géométriquement
    équivalentes.

    Priorité :
        X croissant
        puis Y croissant
        puis Z croissant
    """

    p1 = line.StartPoint
    p2 = line.EndPoint

    dx = p2.X - p1.X
    dy = p2.Y - p1.Y
    dz = p2.Z - p1.Z

    reverse = False

    if dx < -tolerance:

        reverse = True

    elif abs(dx) <= tolerance:

        if dy < -tolerance:

            reverse = True

        elif abs(dy) <= tolerance and dz < -tolerance:

            reverse = True

    if reverse:

        return Line.ByStartPointEndPoint(
            p2,
            p1
        )

    return line


normalized_lines = []

for line in lines:

    try:

        normalized_lines.append(
            normalize_line(line)
        )

    except:

        pass


# ============================================================
# CLE GEOMETRIQUE
# ============================================================

def quantize(value):
    """
    Regroupe les coordonnées situées dans la même
    tolérance géométrique.
    """

    if tolerance <= 0:

        return round(value, 9)

    return int(
        round(value / tolerance)
    )


def line_key(line):

    p1 = line.StartPoint
    p2 = line.EndPoint

    return (
        quantize(p1.X),
        quantize(p1.Y),
        quantize(p1.Z),

        quantize(p2.X),
        quantize(p2.Y),
        quantize(p2.Z)
    )


# ============================================================
# SUPPRIMER LES DOUBLONS
# AVANT LE FILTRE DE LONGUEUR
# ============================================================

unique_lines = []

known_keys = set()

removed_duplicates = 0

for line in normalized_lines:

    try:

        key = line_key(line)

        if key not in known_keys:

            known_keys.add(key)
            unique_lines.append(line)

        else:

            removed_duplicates += 1

    except:

        pass


# ============================================================
# SUPPRIMER LES LIGNES TROP COURTES
# ============================================================

final_lines = []

removed_short = 0

for line in unique_lines:

    try:

        if line.Length >= min_length:

            final_lines.append(line)

        else:

            removed_short += 1

    except:

        pass


# ============================================================
# DIAGNOSTIC
# ============================================================

diagnostic = {
    "Courbes initiales": len(all_curves),
    "Lignes detectees": initial_line_count,
    "Doublons supprimes": removed_duplicates,
    "Lignes courtes supprimees": removed_short,
    "Lignes finales": len(final_lines),
    "Longueur mini mm": min_length_mm,
    "Tolerance mm": tolerance_mm
}


# ============================================================
# OUTPUT
# ============================================================

OUT = final_lines, diagnostic
# ----------------------------------------
code_block_2 = CodeBlock(x=MUR_01_NettoyerCourbes) { x[0]; }
code_block_3 = CodeBlock { 150; 0.1; 10; }
MUR_02_DetecterPairesCandidates = Python(IN[0]=code_block_2, IN[1]=n4_largeur_maxi_mur_mm, IN[2]=code_block_3.out1, IN[3]=code_block_3.out2)  # PythonNet3
# ---------- MUR_02_DetecterPairesCandidates.python (838 lines) ----------
# -*- coding: utf-8 -*-

import clr
import math

clr.AddReference("ProtoGeometry")
from Autodesk.DesignScript.Geometry import Point, Line

clr.AddReference("RevitAPI")
from Autodesk.Revit.DB import UnitUtils, UnitTypeId, SpecTypeId

clr.AddReference("RevitServices")
from RevitServices.Persistence import DocumentManager


# ============================================================
# INPUTS
# ============================================================

lines = IN[0] if IN[0] else []

max_width_mm = (
    float(IN[1])
    if IN[1] is not None
    else 150.0
)

angle_tolerance_deg = (
    float(IN[2])
    if IN[2] is not None
    else 0.1
)

min_overlap_mm = (
    float(IN[3])
    if IN[3] is not None
    else 10.0
)


# ============================================================
# UNITES
# ============================================================

doc = DocumentManager.Instance.CurrentDBDocument

project_unit_id = (
    doc.GetUnits()
       .GetFormatOptions(SpecTypeId.Length)
       .GetUnitTypeId()
)


def mm_to_project(value_mm):

    internal = UnitUtils.ConvertToInternalUnits(
        value_mm,
        UnitTypeId.Millimeters
    )

    return UnitUtils.ConvertFromInternalUnits(
        internal,
        project_unit_id
    )


def project_to_mm(value):

    internal = UnitUtils.ConvertToInternalUnits(
        value,
        project_unit_id
    )

    return UnitUtils.ConvertFromInternalUnits(
        internal,
        UnitTypeId.Millimeters
    )


max_width = mm_to_project(max_width_mm)
min_overlap = mm_to_project(min_overlap_mm)


# ============================================================
# PARAMETRES ANGULAIRES
# ============================================================

angle_tolerance_rad = math.radians(
    angle_tolerance_deg
)

parallel_threshold = math.cos(
    angle_tolerance_rad
)

# La taille d'un bucket correspond à la tolérance.
angle_bucket_size = max(
    angle_tolerance_rad,
    1e-8
)

number_angle_buckets = int(
    math.ceil(
        math.pi / angle_bucket_size
    )
)


# ============================================================
# PRECALCUL DES LIGNES
# ============================================================

data = []

for index, curve in enumerate(lines):

    try:

        p0 = curve.StartPoint
        p1 = curve.EndPoint

        x0 = float(p0.X)
        y0 = float(p0.Y)
        z0 = float(p0.Z)

        x1 = float(p1.X)
        y1 = float(p1.Y)
        z1 = float(p1.Z)

        dx = x1 - x0
        dy = y1 - y0

        length_xy = math.sqrt(
            dx * dx +
            dy * dy
        )

        if length_xy <= 1e-12:
            continue

        ux = dx / length_xy
        uy = dy / length_xy

        # --------------------------------------------
        # Orientation canonique [0 ; pi[
        # --------------------------------------------

        angle = math.atan2(uy, ux)

        if angle < 0.0:
            angle += math.pi

        if angle >= math.pi:
            angle -= math.pi

        # --------------------------------------------
        # Midpoint
        # --------------------------------------------

        mx = 0.5 * (x0 + x1)
        my = 0.5 * (y0 + y1)
        mz = 0.5 * (z0 + z1)

        # --------------------------------------------
        # Bucket orientation
        # --------------------------------------------

        angle_key = int(
            math.floor(
                angle / angle_bucket_size
            )
        )

        if angle_key >= number_angle_buckets:
            angle_key = (
                number_angle_buckets - 1
            )

        data.append({
            "id": index,
            "curve": curve,

            "x0": x0,
            "y0": y0,
            "z0": z0,

            "x1": x1,
            "y1": y1,
            "z1": z1,

            "mx": mx,
            "my": my,
            "mz": mz,

            "ux": ux,
            "uy": uy,

            "length": length_xy,

            "angle": angle,
            "angle_key": angle_key
        })

    except:
        pass


# ============================================================
# INDEX SPATIAL
#
# Structure :
#
# spatial_index[angle_bucket][normal_bucket]
#       -> liste des IDs de lignes
#
# ============================================================

spatial_index = {}


def representative_angle(angle_key):

    return (
        angle_key + 0.5
    ) * angle_bucket_size


for local_id, d in enumerate(data):

    angle_key = d["angle_key"]

    rep_angle = representative_angle(
        angle_key
    )

    # Normale au bucket d'orientation.
    nx = -math.sin(rep_angle)
    ny =  math.cos(rep_angle)

    rho = (
        d["mx"] * nx +
        d["my"] * ny
    )

    normal_key = int(
        math.floor(
            rho / max_width
        )
    )

    if angle_key not in spatial_index:
        spatial_index[angle_key] = {}

    if normal_key not in spatial_index[angle_key]:
        spatial_index[angle_key][normal_key] = []

    spatial_index[
        angle_key
    ][
        normal_key
    ].append(local_id)


# ============================================================
# OUTILS MATHEMATIQUES
# ============================================================

def dot2(ax, ay, bx, by):

    return ax * bx + ay * by


def projection_interval(d, ux, uy):

    s0 = (
        d["x0"] * ux +
        d["y0"] * uy
    )

    s1 = (
        d["x1"] * ux +
        d["y1"] * uy
    )

    if s0 <= s1:
        return s0, s1

    return s1, s0


def point_at_projection(d, ux, uy, s):
    """
    Retourne le point de la ligne d tel que sa
    projection sur la direction (ux, uy) vaut s.
    """

    dx = d["x1"] - d["x0"]
    dy = d["y1"] - d["y0"]
    dz = d["z1"] - d["z0"]

    denominator = (
        dx * ux +
        dy * uy
    )

    if abs(denominator) < 1e-12:
        return None

    s0 = (
        d["x0"] * ux +
        d["y0"] * uy
    )

    t = (s - s0) / denominator

    return (
        d["x0"] + t * dx,
        d["y0"] + t * dy,
        d["z0"] + t * dz
    )


# ============================================================
# RECHERCHE DES PAIRES
# ============================================================

candidate_centerlines = []
candidate_widths_mm = []
candidate_source_pairs = []
candidate_info = []

tested_pairs = set()

broad_phase_count = 0

rejected_angle = 0
rejected_distance = 0
rejected_overlap = 0

candidate_count_per_line = {}


for i, A in enumerate(data):

    # --------------------------------------------------------
    # On regarde :
    #
    # bucket angle courant
    # bucket precedent
    # bucket suivant
    #
    # avec périodicité pi.
    # --------------------------------------------------------

    angle_keys_to_search = [
        (
            A["angle_key"] - 1
        ) % number_angle_buckets,

        A["angle_key"],

        (
            A["angle_key"] + 1
        ) % number_angle_buckets
    ]

    for target_angle_key in angle_keys_to_search:

        if target_angle_key not in spatial_index:
            continue

        rep_angle = representative_angle(
            target_angle_key
        )

        nx_rep = -math.sin(rep_angle)
        ny_rep =  math.cos(rep_angle)

        rho_A = (
            A["mx"] * nx_rep +
            A["my"] * ny_rep
        )

        normal_key_A = int(
            math.floor(
                rho_A / max_width
            )
        )

        # Avec une cellule de taille max_width,
        # une ligne distante de <= max_width
        # ne peut être que dans :
        #
        # q-1 / q / q+1
        #
        for target_normal_key in (
            normal_key_A - 1,
            normal_key_A,
            normal_key_A + 1
        ):

            bucket = spatial_index[
                target_angle_key
            ].get(
                target_normal_key,
                []
            )

            for j in bucket:

                if i == j:
                    continue

                # --------------------------------------------
                # Paire unique
                # --------------------------------------------

                if i < j:
                    pair_key = (i, j)
                else:
                    pair_key = (j, i)

                if pair_key in tested_pairs:
                    continue

                tested_pairs.add(pair_key)

                broad_phase_count += 1

                B = data[j]

                # ============================================
                # C1 - PARALLELISME EXACT
                # ============================================

                dot = abs(
                    dot2(
                        A["ux"],
                        A["uy"],
                        B["ux"],
                        B["uy"]
                    )
                )

                dot = max(
                    -1.0,
                    min(1.0, dot)
                )

                if dot < parallel_threshold:

                    rejected_angle += 1
                    continue

                angle_difference = math.acos(dot)

                # ============================================
                # C3 - DISTANCE ENTRE SUPPORTS
                # ============================================

                # Normale exacte à A
                nx = -A["uy"]
                ny =  A["ux"]

                distance_normal = abs(
                    (
                        B["mx"] - A["mx"]
                    ) * nx
                    +
                    (
                        B["my"] - A["my"]
                    ) * ny
                )

                if (
                    distance_normal <= 1e-9
                    or
                    distance_normal > max_width
                ):

                    rejected_distance += 1
                    continue

                # ============================================
                # C2 - OVERLAP LONGITUDINAL
                # ============================================

                a0, a1 = projection_interval(
                    A,
                    A["ux"],
                    A["uy"]
                )

                b0, b1 = projection_interval(
                    B,
                    A["ux"],
                    A["uy"]
                )

                overlap_start = max(
                    a0,
                    b0
                )

                overlap_end = min(
                    a1,
                    b1
                )

                overlap = (
                    overlap_end -
                    overlap_start
                )

                if overlap < min_overlap:

                    rejected_overlap += 1
                    continue

                # ============================================
                # POINTS CORRESPONDANTS AUX LIMITES OVERLAP
                # ============================================

                A_start = point_at_projection(
                    A,
                    A["ux"],
                    A["uy"],
                    overlap_start
                )

                A_end = point_at_projection(
                    A,
                    A["ux"],
                    A["uy"],
                    overlap_end
                )

                B_start = point_at_projection(
                    B,
                    A["ux"],
                    A["uy"],
                    overlap_start
                )

                B_end = point_at_projection(
                    B,
                    A["ux"],
                    A["uy"],
                    overlap_end
                )

                if (
                    A_start is None
                    or A_end is None
                    or B_start is None
                    or B_end is None
                ):
                    continue

                # ============================================
                # AXE MEDIAN CANDIDAT
                # ============================================

                start_center = (
                    0.5 * (
                        A_start[0] +
                        B_start[0]
                    ),
                    0.5 * (
                        A_start[1] +
                        B_start[1]
                    ),
                    0.5 * (
                        A_start[2] +
                        B_start[2]
                    )
                )

                end_center = (
                    0.5 * (
                        A_end[0] +
                        B_end[0]
                    ),
                    0.5 * (
                        A_end[1] +
                        B_end[1]
                    ),
                    0.5 * (
                        A_end[2] +
                        B_end[2]
                    )
                )

                p_start = Point.ByCoordinates(
                    start_center[0],
                    start_center[1],
                    start_center[2]
                )

                p_end = Point.ByCoordinates(
                    end_center[0],
                    end_center[1],
                    end_center[2]
                )

                centerline = (
                    Line.ByStartPointEndPoint(
                        p_start,
                        p_end
                    )
                )

                # ============================================
                # LARGEUR AU MILIEU DE L'OVERLAP
                # ============================================

                overlap_middle = 0.5 * (
                    overlap_start +
                    overlap_end
                )

                A_middle = point_at_projection(
                    A,
                    A["ux"],
                    A["uy"],
                    overlap_middle
                )

                B_middle = point_at_projection(
                    B,
                    A["ux"],
                    A["uy"],
                    overlap_middle
                )

                dx_width = (
                    B_middle[0] -
                    A_middle[0]
                )

                dy_width = (
                    B_middle[1] -
                    A_middle[1]
                )

                width = math.sqrt(
                    dx_width * dx_width +
                    dy_width * dy_width
                )

                width_mm = project_to_mm(
                    width
                )

                overlap_mm = project_to_mm(
                    overlap
                )

                # ============================================
                # RATIO OVERLAP
                # ============================================

                projected_length_A = (
                    a1 - a0
                )

                projected_length_B = (
                    b1 - b0
                )

                min_projected_length = min(
                    projected_length_A,
                    projected_length_B
                )

                if min_projected_length > 1e-12:

                    overlap_ratio = (
                        overlap /
                        min_projected_length
                    )

                else:

                    overlap_ratio = 0.0

                # ============================================
                # ENREGISTREMENT
                # ============================================

                candidate_centerlines.append(
                    centerline
                )

                candidate_widths_mm.append(
                    width_mm
                )

                candidate_source_pairs.append([
                    A["curve"],
                    B["curve"]
                ])

                candidate_info.append({
                    "SourceA": A["id"],
                    "SourceB": B["id"],

                    "Largeur_mm": round(
                        width_mm,
                        3
                    ),

                    "Overlap_mm": round(
                        overlap_mm,
                        3
                    ),

                    "RatioOverlap": round(
                        overlap_ratio,
                        4
                    ),

                    "AngleDiff_deg": round(
                        math.degrees(
                            angle_difference
                        ),
                        5
                    )
                })

                candidate_count_per_line[
                    A["id"]
                ] = (
                    candidate_count_per_line.get(
                        A["id"],
                        0
                    ) + 1
                )

                candidate_count_per_line[
                    B["id"]
                ] = (
                    candidate_count_per_line.get(
                        B["id"],
                        0
                    ) + 1
                )


# ============================================================
# DIAGNOSTIC
# ============================================================

number_lines = len(data)

possible_pairs_naive = int(
    number_lines *
    (number_lines - 1) /
    2
)

ambiguous_lines = 0

for count in candidate_count_per_line.values():

    if count > 1:
        ambiguous_lines += 1


if broad_phase_count > 0:

    reduction_ratio = (
        1.0 -
        (
            float(broad_phase_count) /
            float(possible_pairs_naive)
        )
    )

else:

    reduction_ratio = 1.0


diagnostic = {

    "Lignes entree":
        number_lines,

    "Couples possibles methode brute":
        possible_pairs_naive,

    "Couples testes apres indexation":
        broad_phase_count,

    "Reduction broad-phase (%)":
        round(
            reduction_ratio * 100.0,
            2
        ),

    "Rejetes angle":
        rejected_angle,

    "Rejetes distance":
        rejected_distance,

    "Rejetes overlap":
        rejected_overlap,

    "Paires candidates":
        len(candidate_centerlines),

    "Lignes avec plusieurs candidats":
        ambiguous_lines,

    "Largeur max mm":
        max_width_mm,

    "Tolerance angle deg":
        angle_tolerance_deg,

    "Overlap minimum mm":
        min_overlap_mm
}


# ============================================================
# OUTPUT
# ============================================================

OUT = (
    candidate_centerlines,
    candidate_widths_mm,
    candidate_source_pairs,
    candidate_info,
    diagnostic
)
# ----------------------------------------
code_block_4 = CodeBlock(x=MUR_02_DetecterPairesCandidates) { x[0]; x[2]; x[3]; }
code_block_5 = CodeBlock { 2; 10; }
MUR_03_ResoudrePairesMur = Python(IN[0]=code_block_4.out1, IN[1]=code_block_4.out2, IN[2]=code_block_5.out0, IN[3]=code_block_5.out1)  # PythonNet3
# ---------- MUR_03_ResoudrePairesMur.python (1875 lines) ----------
# -*- coding: utf-8 -*-

import clr
import math
from collections import defaultdict, deque

clr.AddReference("ProtoGeometry")
from Autodesk.DesignScript.Geometry import Point, Line

clr.AddReference("RevitAPI")
from Autodesk.Revit.DB import UnitUtils, UnitTypeId, SpecTypeId

clr.AddReference("RevitServices")
from RevitServices.Persistence import DocumentManager


# ============================================================
# MUR_03_RESoudrePairesMur
#
# Objectif :
# Transformer les Wall-Prone Pairs du noeud 02 en portions
# de murs cohérentes.
#
# Strategie :
#   1. Construire un WAG simplifie :
#          SourceLine <-> SourceLine
#
#   2. Rechercher les composantes connexes.
#
#   3. Composante simple A-B :
#          accepter directement.
#
#   4. Composante complexe :
#          - decoupage longitudinal
#          - ordre transversal des faces
#          - suppression paires non adjacentes
#          - detection conflits
#          - matching optimal local
#
#   5. Fusionner les portions consecutives.
#
#   6. Construire les axes medians.
#
# IMPORTANT :
# OUT[3] contient uniquement les axes provenant d'une
# zone dans laquelle plusieurs appariements etaient possibles.
# ============================================================


# ============================================================
# 0. INPUTS
# ============================================================

source_pairs = IN[0] if IN[0] else []
candidate_infos = IN[1] if IN[1] else []

merge_tol_mm = (
    float(IN[2])
    if IN[2] is not None
    else 2.0
)

min_length_mm = (
    float(IN[3])
    if IN[3] is not None
    else 10.0
)


# ============================================================
# 1. UNITES REVIT / DYNAMO
# ============================================================

doc = DocumentManager.Instance.CurrentDBDocument

project_unit_id = (
    doc.GetUnits()
       .GetFormatOptions(SpecTypeId.Length)
       .GetUnitTypeId()
)


def mm_to_project(value_mm):

    internal = UnitUtils.ConvertToInternalUnits(
        value_mm,
        UnitTypeId.Millimeters
    )

    return UnitUtils.ConvertFromInternalUnits(
        internal,
        project_unit_id
    )


def project_to_mm(value):

    internal = UnitUtils.ConvertToInternalUnits(
        value,
        project_unit_id
    )

    return UnitUtils.ConvertFromInternalUnits(
        internal,
        UnitTypeId.Millimeters
    )


merge_tol = mm_to_project(merge_tol_mm)
min_length = mm_to_project(min_length_mm)


# ============================================================
# 2. OUTILS GENERAUX
# ============================================================

def get_info(info, key, default=None):
    """
    Lecture robuste d'un Dictionary Dynamo / Python.
    """

    try:
        return info[key]
    except:
        pass

    try:
        return info.get(key, default)
    except:
        return default


def curve_data(curve):
    """
    Informations XY d'une ligne source.
    Retourne une direction canonique.
    """

    try:

        p0 = curve.StartPoint
        p1 = curve.EndPoint

        x0 = float(p0.X)
        y0 = float(p0.Y)
        z0 = float(p0.Z)

        x1 = float(p1.X)
        y1 = float(p1.Y)
        z1 = float(p1.Z)

        dx = x1 - x0
        dy = y1 - y0

        length = math.sqrt(
            dx * dx +
            dy * dy
        )

        if length <= 1e-12:
            return None

        ux = dx / length
        uy = dy / length

        # --------------------------------------------
        # Direction canonique.
        #
        # Une ligne :
        #
        # A ---> B
        #
        # et :
        #
        # B ---> A
        #
        # doivent avoir la meme direction logique.
        # --------------------------------------------

        if (
            ux < 0.0
            or
            (
                abs(ux) < 1e-12
                and uy < 0.0
            )
        ):

            ux = -ux
            uy = -uy

        return {

            "x0": x0,
            "y0": y0,
            "z0": z0,

            "x1": x1,
            "y1": y1,
            "z1": z1,

            "ux": ux,
            "uy": uy,

            "length": length
        }

    except:
        return None


def projection_interval(curve, ux, uy):
    """
    Projection d'une ligne sur l'axe longitudinal u.

    Retour :
        s_min
        s_max
    """

    p0 = curve.StartPoint
    p1 = curve.EndPoint

    s0 = (
        float(p0.X) * ux +
        float(p0.Y) * uy
    )

    s1 = (
        float(p1.X) * ux +
        float(p1.Y) * uy
    )

    if s0 <= s1:
        return s0, s1

    return s1, s0


def point_at_s(curve, ux, uy, s):
    """
    Retourne le point de 'curve' correspondant a la
    coordonnee longitudinale s.

    La courbe est supposee etre une ligne droite.
    """

    p0 = curve.StartPoint
    p1 = curve.EndPoint

    x0 = float(p0.X)
    y0 = float(p0.Y)
    z0 = float(p0.Z)

    x1 = float(p1.X)
    y1 = float(p1.Y)
    z1 = float(p1.Z)

    dx = x1 - x0
    dy = y1 - y0
    dz = z1 - z0

    denominator = (
        dx * ux +
        dy * uy
    )

    if abs(denominator) < 1e-12:
        return None

    s_origin = (
        x0 * ux +
        y0 * uy
    )

    t = (
        (s - s_origin) /
        denominator
    )

    # Protection contre les petites erreurs numériques.
    if (
        t < -1e-6
        or
        t > 1.000001
    ):
        return None

    t = max(
        0.0,
        min(1.0, t)
    )

    return (
        x0 + t * dx,
        y0 + t * dy,
        z0 + t * dz
    )


def distance_between_curves_at_s(
    curve_a,
    curve_b,
    ux,
    uy,
    s
):
    """
    Distance XY entre deux faces au même s longitudinal.
    """

    a = point_at_s(
        curve_a,
        ux,
        uy,
        s
    )

    b = point_at_s(
        curve_b,
        ux,
        uy,
        s
    )

    if (
        a is None
        or
        b is None
    ):
        return None

    dx = b[0] - a[0]
    dy = b[1] - a[1]

    return math.sqrt(
        dx * dx +
        dy * dy
    )


def make_centerline(
    curve_a,
    curve_b,
    ux,
    uy,
    s0,
    s1
):
    """
    Construit l'axe median entre les deux faces
    sur l'intervalle [s0,s1].
    """

    a0 = point_at_s(
        curve_a,
        ux,
        uy,
        s0
    )

    a1 = point_at_s(
        curve_a,
        ux,
        uy,
        s1
    )

    b0 = point_at_s(
        curve_b,
        ux,
        uy,
        s0
    )

    b1 = point_at_s(
        curve_b,
        ux,
        uy,
        s1
    )

    if (
        a0 is None
        or
        a1 is None
        or
        b0 is None
        or
        b1 is None
    ):
        return None

    c0 = (
        0.5 * (a0[0] + b0[0]),
        0.5 * (a0[1] + b0[1]),
        0.5 * (a0[2] + b0[2])
    )

    c1 = (
        0.5 * (a1[0] + b1[0]),
        0.5 * (a1[1] + b1[1]),
        0.5 * (a1[2] + b1[2])
    )

    # Protection ligne nulle.
    dx = c1[0] - c0[0]
    dy = c1[1] - c0[1]
    dz = c1[2] - c0[2]

    if (
        dx * dx +
        dy * dy +
        dz * dz
        <= 1e-18
    ):
        return None

    p0 = Point.ByCoordinates(
        c0[0],
        c0[1],
        c0[2]
    )

    p1 = Point.ByCoordinates(
        c1[0],
        c1[1],
        c1[2]
    )

    return Line.ByStartPointEndPoint(
        p0,
        p1
    )


# ============================================================
# 3. RECONSTRUIRE LES WALL-PRONE PAIRS
# ============================================================

records = []

source_curves = {}

input_count = min(
    len(source_pairs),
    len(candidate_infos)
)


for i in range(input_count):

    try:

        pair = source_pairs[i]
        info = candidate_infos[i]

        if (
            pair is None
            or
            len(pair) < 2
        ):
            continue

        curve_a = pair[0]
        curve_b = pair[1]

        source_a = int(
            get_info(
                info,
                "SourceA",
                -1
            )
        )

        source_b = int(
            get_info(
                info,
                "SourceB",
                -1
            )
        )

        if (
            source_a < 0
            or
            source_b < 0
            or
            source_a == source_b
        ):
            continue

        source_curves[
            source_a
        ] = curve_a

        source_curves[
            source_b
        ] = curve_b

        pair_key = tuple(
            sorted(
                (
                    source_a,
                    source_b
                )
            )
        )

        records.append({

            "id":
                i,

            "sourceA":
                source_a,

            "sourceB":
                source_b,

            "pairKey":
                pair_key,

            "curveA":
                curve_a,

            "curveB":
                curve_b,

            "width_mm":
                float(
                    get_info(
                        info,
                        "Largeur_mm",
                        0.0
                    )
                ),

            "overlap_mm":
                float(
                    get_info(
                        info,
                        "Overlap_mm",
                        0.0
                    )
                )
        })

    except:
        pass


# ============================================================
# 4. CONSTRUIRE LE WAG SIMPLIFIE
#
# Sommet :
#     ligne source
#
# Arete :
#     Wall-Prone Pair detectee par MUR_02
# ============================================================

graph = defaultdict(set)


for record in records:

    a = record["sourceA"]
    b = record["sourceB"]

    graph[a].add(b)
    graph[b].add(a)


# ============================================================
# 5. CONNECTED COMPONENTS
# ============================================================

components = []

visited = set()


for start_node in graph:

    if start_node in visited:
        continue

    queue = deque([start_node])

    visited.add(
        start_node
    )

    component = set()

    while queue:

        current = queue.popleft()

        component.add(
            current
        )

        for neighbour in graph[current]:

            if neighbour in visited:
                continue

            visited.add(
                neighbour
            )

            queue.append(
                neighbour
            )

    components.append(
        component
    )


# ============================================================
# 6. ASSOCIER LES RECORDS AUX COMPOSANTES
#
# Optimisation :
# on cree directement une table source -> composante.
# Cela evite de rescanner inutilement tout le graphe.
# ============================================================

source_to_component = {}


for component_index, component in enumerate(
    components
):

    for source_id in component:

        source_to_component[
            source_id
        ] = component_index


component_records = [
    []
    for _ in components
]


for record in records:

    component_index = (
        source_to_component.get(
            record["sourceA"]
        )
    )

    if component_index is None:
        continue

    component_records[
        component_index
    ].append(
        record
    )


# ============================================================
# 7. RESULTATS INTERMEDIAIRES
# ============================================================

atomic_results = []


# ------------------------------------------------------------
# Diagnostics
# ------------------------------------------------------------

simple_components = 0
complex_components = 0

direct_pairs = 0

longitudinal_slices = 0

non_adjacent_rejected = 0

conflict_slices = 0

complex_selected_atoms = 0

largest_component = 0


# ============================================================
# 8. TRAITEMENT DE CHAQUE COMPOSANTE
# ============================================================

for component_index, component in enumerate(
    components
):

    local_records = (
        component_records[
            component_index
        ]
    )

    component_size = len(
        component
    )

    largest_component = max(
        largest_component,
        component_size
    )


    # ========================================================
    # 8A. COMPOSANTE SIMPLE
    #
    # A =================
    #
    # B =================
    #
    # Graphe :
    #
    # A -------- B
    #
    # Aucun choix topologique n'est necessaire.
    # ========================================================

    if (
        component_size == 2
        and
        len(local_records) == 1
    ):

        simple_components += 1
        direct_pairs += 1

        record = local_records[0]

        d = curve_data(
            record["curveA"]
        )

        if d is None:
            continue

        ux = d["ux"]
        uy = d["uy"]


        # --------------------------------------------
        # Domaine commun des deux faces
        # --------------------------------------------

        a0, a1 = projection_interval(
            record["curveA"],
            ux,
            uy
        )

        b0, b1 = projection_interval(
            record["curveB"],
            ux,
            uy
        )

        s0 = max(
            a0,
            b0
        )

        s1 = min(
            a1,
            b1
        )


        if (
            s1 - s0
            < min_length
        ):
            continue


        s_mid = 0.5 * (
            s0 +
            s1
        )


        width = (
            distance_between_curves_at_s(
                record["curveA"],
                record["curveB"],
                ux,
                uy,
                s_mid
            )
        )


        if width is None:
            continue


        atomic_results.append({

            "component":
                component_index,

            "complex":
                False,

            "conflict":
                False,

            "sourceA":
                record["sourceA"],

            "sourceB":
                record["sourceB"],

            "pairKey":
                record["pairKey"],

            "curveA":
                record["curveA"],

            "curveB":
                record["curveB"],

            "ux":
                ux,

            "uy":
                uy,

            "s0":
                s0,

            "s1":
                s1,

            "width":
                width
        })

        continue


    # ========================================================
    # 8B. COMPOSANTE COMPLEXE
    # ========================================================

    complex_components += 1


    if not local_records:
        continue


    # --------------------------------------------------------
    # Direction representative
    #
    # Toutes les relations ont deja ete acceptees comme
    # paralleles par le noeud 02.
    # --------------------------------------------------------

    first_record = local_records[0]

    d = curve_data(
        first_record["curveA"]
    )

    if d is None:
        continue

    ux = d["ux"]
    uy = d["uy"]

    # Normale transverse.
    nx = -uy
    ny = ux


    # ========================================================
    # 9. DOMAINES D'OVERLAP DES ARETES
    # ========================================================

    valid_records = []

    boundaries = []


    for record in local_records:

        a0, a1 = projection_interval(
            record["curveA"],
            ux,
            uy
        )

        b0, b1 = projection_interval(
            record["curveB"],
            ux,
            uy
        )

        s0 = max(
            a0,
            b0
        )

        s1 = min(
            a1,
            b1
        )


        if (
            s1 - s0
            < min_length
        ):
            continue


        local_record = dict(
            record
        )

        local_record["s0"] = s0
        local_record["s1"] = s1


        valid_records.append(
            local_record
        )

        boundaries.append(
            s0
        )

        boundaries.append(
            s1
        )


    if not boundaries:
        continue


    # ========================================================
    # 10. FUSION DES FRONTIERES PRESQUE IDENTIQUES
    # ========================================================

    boundaries.sort()

    merged_boundaries = []


    for value in boundaries:

        if not merged_boundaries:

            merged_boundaries.append(
                value
            )

            continue


        previous = (
            merged_boundaries[-1]
        )


        if (
            abs(
                value -
                previous
            )
            <= merge_tol
        ):

            # Moyenne des deux positions.
            merged_boundaries[-1] = (
                0.5 *
                (
                    previous +
                    value
                )
            )

        else:

            merged_boundaries.append(
                value
            )


    # ========================================================
    # 11. DECOUPAGE EN TRANCHES LONGITUDINALES
    # ========================================================

    for boundary_index in range(
        len(merged_boundaries) - 1
    ):

        s0 = (
            merged_boundaries[
                boundary_index
            ]
        )

        s1 = (
            merged_boundaries[
                boundary_index + 1
            ]
        )


        if (
            s1 - s0
            < min_length
        ):
            continue


        s_mid = 0.5 * (
            s0 +
            s1
        )


        # ====================================================
        # 12. RELATIONS ACTIVES SUR CETTE TRANCHE
        # ====================================================

        slice_records = []


        for record in valid_records:

            if (
                record["s0"]
                <=
                s_mid + merge_tol
                and
                record["s1"]
                >=
                s_mid - merge_tol
            ):

                slice_records.append(
                    record
                )


        if not slice_records:
            continue


        longitudinal_slices += 1


        # ====================================================
        # 13. SOURCES ACTIVES
        # ====================================================

        active_sources = set()


        for record in slice_records:

            active_sources.add(
                record["sourceA"]
            )

            active_sources.add(
                record["sourceB"]
            )


        # ====================================================
        # 14. POSITION TRANSVERSALE DES FACES
        #
        # rho = P . n
        #
        # Cela permet d'obtenir :
        #
        # A
        # B
        # C
        #
        # dans leur ordre physique.
        # ====================================================

        ordered = []


        for source_id in active_sources:

            curve = source_curves.get(
                source_id
            )

            if curve is None:
                continue


            p = point_at_s(
                curve,
                ux,
                uy,
                s_mid
            )


            if p is None:
                continue


            rho = (
                p[0] * nx +
                p[1] * ny
            )


            ordered.append(
                (
                    rho,
                    source_id
                )
            )


        ordered.sort(
            key=lambda item:
                item[0]
        )


        ordered_sources = [
            item[1]
            for item in ordered
        ]


        rank = {

            source_id:
                index

            for index, source_id
            in enumerate(
                ordered_sources
            )
        }


        # ====================================================
        # 15. GARDER UNIQUEMENT LES FACES ADJACENTES
        #
        # A ----------------
        #
        # B ----------------
        #
        # C ----------------
        #
        # A-C est rejetee car B est entre les deux.
        # ====================================================

        available_edges = {}


        for record in slice_records:

            source_a = (
                record["sourceA"]
            )

            source_b = (
                record["sourceB"]
            )


            if (
                source_a not in rank
                or
                source_b not in rank
            ):
                continue


            rank_a = rank[
                source_a
            ]

            rank_b = rank[
                source_b
            ]


            if (
                abs(
                    rank_a -
                    rank_b
                )
                != 1
            ):

                non_adjacent_rejected += 1
                continue


            edge = (
                min(
                    rank_a,
                    rank_b
                ),
                max(
                    rank_a,
                    rank_b
                )
            )


            width = (
                distance_between_curves_at_s(
                    record["curveA"],
                    record["curveB"],
                    ux,
                    uy,
                    s_mid
                )
            )


            if width is None:
                continue


            # Théoriquement une seule relation par paire.
            # On conserve néanmoins la plus petite largeur
            # en cas de duplication inattendue.
            if edge not in available_edges:

                available_edges[
                    edge
                ] = (
                    record,
                    width
                )

            else:

                previous_width = (
                    available_edges[
                        edge
                    ][1]
                )

                if (
                    width <
                    previous_width
                ):

                    available_edges[
                        edge
                    ] = (
                        record,
                        width
                    )


        if not available_edges:
            continue


        # ====================================================
        # 16. DETECTION D'UNE ZONE DE CONFLIT
        #
        # Exemple :
        #
        # A-B
        # B-C
        #
        # B participe à deux possibilités.
        # ====================================================

        degree = defaultdict(int)


        for edge in available_edges:

            degree[
                edge[0]
            ] += 1

            degree[
                edge[1]
            ] += 1


        has_conflict = any(
            value > 1
            for value
            in degree.values()
        )


        if has_conflict:

            conflict_slices += 1


        # ====================================================
        # 17. MATCHING OPTIMAL SUR LA CHAINE TRANSVERSALE
        #
        # Priorite 1 :
        #   maximiser le nombre de murs.
        #
        # Priorite 2 :
        #   à nombre égal,
        #   minimiser la somme des epaisseurs.
        #
        # Cela interdit qu'une meme face soit utilisee
        # deux fois au meme endroit.
        # ====================================================

        n_sources = len(
            ordered_sources
        )


        # dp[i] =
        #
        # (
        #   nombre de paires retenues,
        #   cout largeur,
        #   liste des edges
        # )

        dp = [
            (
                0,
                0.0,
                []
            )
            for _ in range(
                n_sources + 1
            )
        ]


        for i in range(
            1,
            n_sources + 1
        ):

            # --------------------------------------------
            # OPTION A :
            #
            # laisser la face i-1 sans partenaire.
            # --------------------------------------------

            best_count = (
                dp[i - 1][0]
            )

            best_cost = (
                dp[i - 1][1]
            )

            best_edges = list(
                dp[i - 1][2]
            )


            # --------------------------------------------
            # OPTION B :
            #
            # apparier les faces i-2 et i-1.
            # --------------------------------------------

            if i >= 2:

                edge = (
                    i - 2,
                    i - 1
                )


                if edge in available_edges:

                    record, width = (
                        available_edges[
                            edge
                        ]
                    )


                    candidate_count = (
                        dp[i - 2][0] +
                        1
                    )

                    candidate_cost = (
                        dp[i - 2][1] +
                        width
                    )

                    candidate_edges = list(
                        dp[i - 2][2]
                    )

                    candidate_edges.append(
                        edge
                    )


                    better = False


                    if (
                        candidate_count >
                        best_count
                    ):

                        better = True


                    elif (
                        candidate_count ==
                        best_count
                        and
                        candidate_cost <
                        best_cost
                    ):

                        better = True


                    if better:

                        best_count = (
                            candidate_count
                        )

                        best_cost = (
                            candidate_cost
                        )

                        best_edges = (
                            candidate_edges
                        )


            dp[i] = (
                best_count,
                best_cost,
                best_edges
            )


        selected_edges = (
            dp[n_sources][2]
        )


        # ====================================================
        # 18. ENREGISTREMENT DES PORTIONS RETENUES
        # ====================================================

        for edge in selected_edges:

            record, width = (
                available_edges[
                    edge
                ]
            )


            atomic_results.append({

                "component":
                    component_index,

                "complex":
                    True,

                "conflict":
                    has_conflict,

                "sourceA":
                    record["sourceA"],

                "sourceB":
                    record["sourceB"],

                "pairKey":
                    record["pairKey"],

                "curveA":
                    record["curveA"],

                "curveB":
                    record["curveB"],

                "ux":
                    ux,

                "uy":
                    uy,

                "s0":
                    s0,

                "s1":
                    s1,

                "width":
                    width
            })


            complex_selected_atoms += 1


# ============================================================
# 19. REGROUPER LES PORTIONS PAR PAIRE
# ============================================================

by_pair = defaultdict(list)


for atom in atomic_results:

    key = (
        atom["component"],
        atom["pairKey"]
    )

    by_pair[
        key
    ].append(
        atom
    )


# ============================================================
# 20. FUSIONNER LES PORTIONS SUCCESSIVES
#
# Exemple :
#
# -------- A-B --------
# -------- A-B --------
# -------- A-B --------
#
# devient :
#
# ---------------- A-B ----------------
# ============================================================

merged_results = []


for key, atoms in by_pair.items():

    atoms.sort(
        key=lambda item:
            item["s0"]
    )

    current = None


    for atom in atoms:

        if current is None:

            current = dict(
                atom
            )

            continue


        gap = (
            atom["s0"] -
            current["s1"]
        )


        if gap <= merge_tol:

            current["s1"] = max(
                current["s1"],
                atom["s1"]
            )

            # Si au moins une portion provenait d'une
            # zone de conflit, le segment fusionné garde
            # cette information.
            current["conflict"] = (
                current["conflict"]
                or
                atom["conflict"]
            )

        else:

            merged_results.append(
                current
            )

            current = dict(
                atom
            )


    if current is not None:

        merged_results.append(
            current
        )


# ============================================================
# 21. CONSTRUCTION DES AXES FINAUX
# ============================================================

resolved_axes = []

resolved_widths_mm = []

resolved_infos = []

conflict_axes = []


for record in merged_results:

    length = (
        record["s1"] -
        record["s0"]
    )


    if length < min_length:
        continue


    axis = make_centerline(
        record["curveA"],
        record["curveB"],
        record["ux"],
        record["uy"],
        record["s0"],
        record["s1"]
    )


    if axis is None:
        continue


    s_mid = 0.5 * (
        record["s0"] +
        record["s1"]
    )


    width = (
        distance_between_curves_at_s(
            record["curveA"],
            record["curveB"],
            record["ux"],
            record["uy"],
            s_mid
        )
    )


    if width is None:
        continue


    width_mm = (
        project_to_mm(
            width
        )
    )

    length_mm = (
        project_to_mm(
            length
        )
    )


    resolved_axes.append(
        axis
    )


    resolved_widths_mm.append(
        width_mm
    )


    resolved_infos.append({

        "Composante":
            record["component"],

        "SourceA":
            record["sourceA"],

        "SourceB":
            record["sourceB"],

        "Largeur_mm":
            round(
                width_mm,
                3
            ),

        "Longueur_mm":
            round(
                length_mm,
                3
            ),

        "ComposanteComplexe":
            record["complex"],

        "ZoneConflit":
            record["conflict"]
    })


    # --------------------------------------------------------
    # IMPORTANT :
    #
    # uniquement les axes pour lesquels le matching
    # a dû résoudre un vrai conflit.
    # --------------------------------------------------------

    if record["conflict"]:

        conflict_axes.append(
            axis
        )


# ============================================================
# 22. STATISTIQUES COMPLEMENTAIRES
# ============================================================

number_sources = len(
    source_curves
)

number_edges = len(
    records
)

number_final = len(
    resolved_axes
)


# Distribution taille des composantes.
component_sizes = [
    len(component)
    for component in components
]


if component_sizes:

    average_component_size = (
        float(
            sum(component_sizes)
        )
        /
        float(
            len(component_sizes)
        )
    )

else:

    average_component_size = 0.0


# ============================================================
# 23. DIAGNOSTIC
# ============================================================

diagnostic = {

    "Paires candidates entree":
        number_edges,

    "Faces sources impliquees":
        number_sources,

    "Composantes totales":
        len(components),

    "Composantes simples":
        simple_components,

    "Composantes complexes":
        complex_components,

    "Taille plus grande composante":
        largest_component,

    "Taille moyenne composante":
        round(
            average_component_size,
            2
        ),

    "Paires directes":
        direct_pairs,

    "Tranches complexes analysees":
        longitudinal_slices,

    "Paires non adjacentes rejetees":
        non_adjacent_rejected,

    "Tranches avec conflit":
        conflict_slices,

    "Portions complexes retenues":
        complex_selected_atoms,

    "Portions totales avant fusion":
        len(atomic_results),

    "Segments apres fusion":
        number_final,

    "Segments issus zone conflit":
        len(conflict_axes),

    "Tolerance fusion mm":
        merge_tol_mm,

    "Longueur mini mm":
        min_length_mm
}


# ============================================================
# 24. OUTPUT
# ============================================================

OUT = (
    resolved_axes,
    resolved_widths_mm,
    resolved_infos,
    conflict_axes,
    diagnostic
)
# ----------------------------------------
code_block_6 = CodeBlock(x=MUR_03_ResoudrePairesMur) { x[0]; x[1]; x[2]; }
curvesFromCADLayers_2 = CAD.CurvesFromCADLayers(importInstance=n1_plan_dwg, layerNames=n3_calque_porte)
code_block_7 = CodeBlock { 0.001; 5; }
PORTE_01_RegrouperCourbes = Python(IN[0]=curvesFromCADLayers_2.Curve, IN[1]=code_block_7.out0, IN[2]=code_block_7.out1)  # PythonNet3; unwired: IN[3]
# ---------- PORTE_01_RegrouperCourbes.python (1158 lines) ----------
# -*- coding: utf-8 -*-

import clr
import math
from collections import deque

clr.AddReference("ProtoGeometry")
from Autodesk.DesignScript.Geometry import Point, Line

clr.AddReference("RevitAPI")
from Autodesk.Revit.DB import UnitUtils, UnitTypeId, SpecTypeId

clr.AddReference("RevitServices")
from RevitServices.Persistence import DocumentManager


# ============================================================
# PORTE_01_RegrouperCourbes
#
# 1. Flatten des courbes CO-Porte
# 2. Regroupement par connectivité des extrémités
# 3. Une composante connexe = une porte potentielle
# 4. Calcul d'un rectangle minimum orienté 2D
# 5. Création de 4 lignes DesignScript visibles dans Dynamo
#
# Aucun besoin de reconnaître :
# - porte simple
# - porte double
# - charnière
# - vantail
#
# ============================================================


# ============================================================
# INPUTS
# ============================================================

input_curves = IN[0]

connection_tol_mm = (
    float(IN[1])
    if IN[1] is not None
    else 30
)

min_curves_group = (
    int(IN[2])
    if IN[2] is not None
    else 2
)

samples_per_curve = (
    int(IN[3])
    if IN[3] is not None
    else 12
)

samples_per_curve = max(
    2,
    samples_per_curve
)


# ============================================================
# FLATTEN RECURSIF
# ============================================================

def flatten(data):

    result = []

    if isinstance(data, (list, tuple)):

        for item in data:
            result.extend(
                flatten(item)
            )

    elif data is not None:

        result.append(data)

    return result


curves = flatten(
    input_curves
)


# ============================================================
# UNITES
# ============================================================

doc = DocumentManager.Instance.CurrentDBDocument

project_unit_id = (
    doc.GetUnits()
       .GetFormatOptions(SpecTypeId.Length)
       .GetUnitTypeId()
)


def mm_to_project(value_mm):

    internal = UnitUtils.ConvertToInternalUnits(
        value_mm,
        UnitTypeId.Millimeters
    )

    return UnitUtils.ConvertFromInternalUnits(
        internal,
        project_unit_id
    )


def project_to_mm(value):

    internal = UnitUtils.ConvertToInternalUnits(
        value,
        project_unit_id
    )

    return UnitUtils.ConvertFromInternalUnits(
        internal,
        UnitTypeId.Millimeters
    )


connection_tol = mm_to_project(
    connection_tol_mm
)


# ============================================================
# OUTILS GEOMETRIQUES
# ============================================================

def xyz(point):

    return (
        float(point.X),
        float(point.Y),
        float(point.Z)
    )


def distance_3d(a, b):

    dx = a[0] - b[0]
    dy = a[1] - b[1]
    dz = a[2] - b[2]

    return math.sqrt(
        dx * dx +
        dy * dy +
        dz * dz
    )


def get_endpoints(curve):

    try:

        p0 = xyz(
            curve.StartPoint
        )

        p1 = xyz(
            curve.EndPoint
        )

        return p0, p1

    except:

        return None


# ============================================================
# ECHANTILLONNAGE D'UNE COURBE
#
# On essaie d'utiliser PointAtParameter afin de prendre
# correctement en compte les arcs.
#
# Si cela échoue, on utilise StartPoint / EndPoint.
# ============================================================

def sample_curve(curve, count):

    points = []

    # --------------------------------------------------------
    # Essai PointAtParameter
    # DesignScript utilise généralement un paramètre normalisé
    # 0 -> 1.
    # --------------------------------------------------------

    try:

        for i in range(count + 1):

            t = float(i) / float(count)

            p = curve.PointAtParameter(t)

            if p is not None:

                points.append(
                    xyz(p)
                )

                try:
                    p.Dispose()
                except:
                    pass

        if len(points) >= 2:

            return points

    except:
        pass


    # --------------------------------------------------------
    # Fallback
    # --------------------------------------------------------

    endpoints = get_endpoints(
        curve
    )

    if endpoints is not None:

        return [
            endpoints[0],
            endpoints[1]
        ]

    return []


# ============================================================
# PREPARATION DES COURBES
# ============================================================

valid_curves = []

curve_endpoints = []

invalid_curves = []


for curve in curves:

    endpoints = get_endpoints(
        curve
    )

    if endpoints is None:

        invalid_curves.append(
            curve
        )

        continue

    valid_curves.append(
        curve
    )

    curve_endpoints.append(
        endpoints
    )


n = len(
    valid_curves
)


# ============================================================
# GRAPHE DE CONNEXION
#
# Deux courbes appartiennent au même graphe si au moins
# deux de leurs extrémités sont suffisamment proches.
#
# On conserve la logique validée lors du test précédent.
# ============================================================

adjacency = [
    set()
    for _ in range(n)
]

connection_count = 0


for i in range(n):

    a0, a1 = curve_endpoints[i]

    for j in range(
        i + 1,
        n
    ):

        b0, b1 = curve_endpoints[j]

        minimum_distance = min(

            distance_3d(
                a0,
                b0
            ),

            distance_3d(
                a0,
                b1
            ),

            distance_3d(
                a1,
                b0
            ),

            distance_3d(
                a1,
                b1
            )
        )

        if (
            minimum_distance <=
            connection_tol
        ):

            adjacency[i].add(j)

            adjacency[j].add(i)

            connection_count += 1


# ============================================================
# COMPOSANTES CONNEXES
# ============================================================

visited = set()

components = []


for start in range(n):

    if start in visited:
        continue

    queue = deque(
        [start]
    )

    visited.add(
        start
    )

    component = []


    while queue:

        current = queue.popleft()

        component.append(
            current
        )

        for neighbour in adjacency[current]:

            if neighbour not in visited:

                visited.add(
                    neighbour
                )

                queue.append(
                    neighbour
                )

    components.append(
        component
    )


# ============================================================
# GROUPES VALIDES
# ============================================================

groups = []

rejected_curves = list(
    invalid_curves
)

group_sizes = []


for component in components:

    component_curves = [

        valid_curves[i]

        for i in component
    ]

    if (
        len(component_curves) >=
        min_curves_group
    ):

        groups.append(
            component_curves
        )

        group_sizes.append(
            len(component_curves)
        )

    else:

        rejected_curves.extend(
            component_curves
        )


# ============================================================
# CONVEX HULL 2D
#
# Algorithme monotonic chain.
#
# Le convex hull permet de réduire fortement le nombre de
# points avant la recherche du rectangle minimum.
# ============================================================

def cross(o, a, b):

    return (
        (a[0] - o[0]) *
        (b[1] - o[1])
        -
        (a[1] - o[1]) *
        (b[0] - o[0])
    )


def convex_hull(points):

    # Suppression des doublons XY
    unique = {}

    for p in points:

        key = (
            round(p[0], 9),
            round(p[1], 9)
        )

        if key not in unique:

            unique[key] = p


    pts = list(
        unique.values()
    )

    pts.sort(
        key=lambda p:
        (
            p[0],
            p[1]
        )
    )


    if len(pts) <= 2:

        return pts


    lower = []

    for p in pts:

        while (
            len(lower) >= 2
            and
            cross(
                lower[-2],
                lower[-1],
                p
            ) <= 0.0
        ):

            lower.pop()

        lower.append(p)


    upper = []

    for p in reversed(pts):

        while (
            len(upper) >= 2
            and
            cross(
                upper[-2],
                upper[-1],
                p
            ) <= 0.0
        ):

            upper.pop()

        upper.append(p)


    return (
        lower[:-1] +
        upper[:-1]
    )


# ============================================================
# RECTANGLE MINIMUM ORIENTE
#
# Pour chaque direction d'arête du convex hull :
#
# - rotation virtuelle des points
# - calcul min/max X/Y
# - aire du rectangle
#
# On conserve le rectangle de plus petite aire.
#
# Pour nos symboles de portes 2D, cette méthode est très
# adaptée.
# ============================================================

def minimum_oriented_rectangle(points):

    hull = convex_hull(
        points
    )


    if len(hull) < 2:

        return None


    # Z moyen du groupe
    z_value = (
        sum(
            p[2]
            for p in points
        )
        /
        float(len(points))
    )


    best = None


    for i in range(
        len(hull)
    ):

        p0 = hull[i]

        p1 = hull[
            (i + 1) %
            len(hull)
        ]


        dx = (
            p1[0] -
            p0[0]
        )

        dy = (
            p1[1] -
            p0[1]
        )


        length = math.sqrt(
            dx * dx +
            dy * dy
        )


        if length <= 1e-12:
            continue


        # Axe local U
        ux = dx / length
        uy = dy / length

        # Axe local V
        vx = -uy
        vy = ux


        min_u = float("inf")
        max_u = float("-inf")

        min_v = float("inf")
        max_v = float("-inf")


        for p in hull:

            u = (
                p[0] * ux +
                p[1] * uy
            )

            v = (
                p[0] * vx +
                p[1] * vy
            )


            if u < min_u:
                min_u = u

            if u > max_u:
                max_u = u

            if v < min_v:
                min_v = v

            if v > max_v:
                max_v = v


        size_u = (
            max_u -
            min_u
        )

        size_v = (
            max_v -
            min_v
        )


        area = (
            size_u *
            size_v
        )


        if (
            best is None
            or
            area < best["area"]
        ):

            best = {

                "area":
                    area,

                "ux":
                    ux,

                "uy":
                    uy,

                "vx":
                    vx,

                "vy":
                    vy,

                "min_u":
                    min_u,

                "max_u":
                    max_u,

                "min_v":
                    min_v,

                "max_v":
                    max_v,

                "size_u":
                    size_u,

                "size_v":
                    size_v,

                "z":
                    z_value
            }


    if best is None:

        return None


    # ========================================================
    # COINS DU RECTANGLE
    # ========================================================

    ux = best["ux"]
    uy = best["uy"]

    vx = best["vx"]
    vy = best["vy"]

    z = best["z"]


    def local_to_global(u, v):

        x = (
            u * ux +
            v * vx
        )

        y = (
            u * uy +
            v * vy
        )

        return (
            x,
            y,
            z
        )


    c0 = local_to_global(
        best["min_u"],
        best["min_v"]
    )

    c1 = local_to_global(
        best["max_u"],
        best["min_v"]
    )

    c2 = local_to_global(
        best["max_u"],
        best["max_v"]
    )

    c3 = local_to_global(
        best["min_u"],
        best["max_v"]
    )


    best["corners"] = [
        c0,
        c1,
        c2,
        c3
    ]


    # ========================================================
    # CENTRE
    # ========================================================

    center_u = (
        best["min_u"] +
        best["max_u"]
    ) * 0.5

    center_v = (
        best["min_v"] +
        best["max_v"]
    ) * 0.5


    best["center"] = (
        center_u * ux +
        center_v * vx,

        center_u * uy +
        center_v * vy,

        z
    )


    # ========================================================
    # On normalise :
    #
    # longueur = grande dimension
    # largeur  = petite dimension
    #
    # direction_longue = direction de la grande dimension
    # ========================================================

    if (
        best["size_u"] >=
        best["size_v"]
    ):

        best["long_size"] = (
            best["size_u"]
        )

        best["short_size"] = (
            best["size_v"]
        )

        best["long_dir"] = (
            ux,
            uy
        )

    else:

        best["long_size"] = (
            best["size_v"]
        )

        best["short_size"] = (
            best["size_u"]
        )

        best["long_dir"] = (
            vx,
            vy
        )


    angle = math.degrees(
        math.atan2(
            best["long_dir"][1],
            best["long_dir"][0]
        )
    )


    # Orientation sans sens :
    # 0 <= angle < 180
    angle = (
        angle %
        180.0
    )


    best["angle_deg"] = (
        angle
    )


    return best


# ============================================================
# CREATION DES RECTANGLES DESIGN SCRIPT
# ============================================================

rectangles = []

rectangle_infos = []

failed_rectangles = 0


for group_index, group in enumerate(
    groups
):

    points = []


    # --------------------------------------------------------
    # Echantillonner toutes les courbes du groupe
    # --------------------------------------------------------

    for curve in group:

        curve_points = sample_curve(
            curve,
            samples_per_curve
        )

        points.extend(
            curve_points
        )


    if len(points) < 2:

        rectangles.append(
            []
        )

        rectangle_infos.append({

            "Groupe":
                group_index,

            "Valide":
                False
        })

        failed_rectangles += 1

        continue


    result = minimum_oriented_rectangle(
        points
    )


    if result is None:

        rectangles.append(
            []
        )

        rectangle_infos.append({

            "Groupe":
                group_index,

            "Valide":
                False
        })

        failed_rectangles += 1

        continue


    corners = result[
        "corners"
    ]


    # --------------------------------------------------------
    # Créer 4 points DS
    # --------------------------------------------------------

    ds_points = []

    for c in corners:

        ds_points.append(
            Point.ByCoordinates(
                c[0],
                c[1],
                c[2]
            )
        )


    # --------------------------------------------------------
    # Créer 4 lignes fermées
    # --------------------------------------------------------

    rectangle_lines = []

    for i in range(4):

        line = Line.ByStartPointEndPoint(

            ds_points[i],

            ds_points[
                (i + 1) % 4
            ]
        )

        rectangle_lines.append(
            line
        )


    rectangles.append(
        rectangle_lines
    )


    # --------------------------------------------------------
    # Centre DS
    # --------------------------------------------------------

    center = result[
        "center"
    ]

    center_point = (
        Point.ByCoordinates(
            center[0],
            center[1],
            center[2]
        )
    )


    # --------------------------------------------------------
    # Informations utiles pour MUR_04
    # --------------------------------------------------------

    rectangle_infos.append({

        "Groupe":
            group_index,

        "Valide":
            True,

        "NbCourbes":
            len(group),

        "Centre":
            center_point,

        "GrandeDimension_mm":
            round(
                project_to_mm(
                    result[
                        "long_size"
                    ]
                ),
                1
            ),

        "PetiteDimension_mm":
            round(
                project_to_mm(
                    result[
                        "short_size"
                    ]
                ),
                1
            ),

        "Angle_deg":
            round(
                result[
                    "angle_deg"
                ],
                3
            )
    })


# ============================================================
# DIAGNOSTIC
# ============================================================

largest_group = (
    max(group_sizes)
    if group_sizes
    else 0
)

smallest_group = (
    min(group_sizes)
    if group_sizes
    else 0
)

average_group = (
    round(
        sum(group_sizes) /
        float(len(group_sizes)),
        2
    )
    if group_sizes
    else 0
)


diagnostic = {

    "Courbes entree":
        len(curves),

    "Courbes valides":
        len(valid_curves),

    "Courbes invalides":
        len(invalid_curves),

    "Connexions detectees":
        connection_count,

    "Composantes totales":
        len(components),

    "Groupes portes":
        len(groups),

    "Rectangles generes":
        (
            len(groups) -
            failed_rectangles
        ),

    "Rectangles echoues":
        failed_rectangles,

    "Courbes rejetees/isolees":
        len(rejected_curves),

    "Taille groupe minimum":
        smallest_group,

    "Taille groupe maximum":
        largest_group,

    "Taille groupe moyenne":
        average_group,

    "Tolerance connexion mm":
        connection_tol_mm,

    "Nb minimum courbes groupe":
        min_curves_group,

    "Echantillons par courbe":
        samples_per_curve
}


# ============================================================
# OUTPUT
# ============================================================

OUT = (
    groups,             # OUT[0]
    rectangles,         # OUT[1]
    rectangle_infos,    # OUT[2]
    rejected_curves,    # OUT[3]
    diagnostic          # OUT[4]
)
# ----------------------------------------
code_block_8 = CodeBlock(x=PORTE_01_RegrouperCourbes) { x[0]; x[1]; x[3]; }
MUR_04_AssocierPortesAxes = Python(IN[0]=code_block_6.out0, IN[1]=code_block_6.out1, IN[2]=code_block_8.out1, IN[3]=code_block_8.out2)  # PythonNet3; unwired: IN[4], IN[5], IN[6]
# ---------- MUR_04_AssocierPortesAxes.python (1392 lines) ----------
# -*- coding: utf-8 -*-

import clr
import math

clr.AddReference("ProtoGeometry")
from Autodesk.DesignScript.Geometry import Point, Line

clr.AddReference("RevitAPI")
from Autodesk.Revit.DB import UnitUtils, UnitTypeId, SpecTypeId

clr.AddReference("RevitServices")
from RevitServices.Persistence import DocumentManager


# ============================================================
# MUR_04_AssocierPortesAxes V2
#
# CAS A
# Deux axes colineaires de part et d'autre d'une porte :
#
#   --------> [PORTE] <--------
#
#   => connexion entre les deux axes
#
#
# CAS B
# Un seul axe arrive vers la porte :
#
#   --------> [PORTE]
#
#   => prolongement de cet axe jusqu'au côté opposé
#      du rectangle.
#
#
# Ce noeud produit de la géométrie proposée.
# Il ne modifie pas encore définitivement les axes MUR_03.
# ============================================================


# ============================================================
# INPUTS
# ============================================================

wall_axes = IN[0] if IN[0] else []
wall_widths_mm = IN[1] if IN[1] else []

door_rectangles = IN[2] if IN[2] else []
door_infos = IN[3] if IN[3] else []

search_distance_mm = (
    float(IN[4])
    if IN[4] is not None
    else 300.0
)

collinear_tol_mm = (
    float(IN[5])
    if IN[5] is not None
    else 30.0
)

angle_tol_deg = (
    float(IN[6])
    if IN[6] is not None
    else 1.0
)


# ============================================================
# UNITES
# ============================================================

doc = DocumentManager.Instance.CurrentDBDocument

project_unit_id = (
    doc.GetUnits()
       .GetFormatOptions(SpecTypeId.Length)
       .GetUnitTypeId()
)


def mm_to_project(value_mm):

    internal = UnitUtils.ConvertToInternalUnits(
        value_mm,
        UnitTypeId.Millimeters
    )

    return UnitUtils.ConvertFromInternalUnits(
        internal,
        project_unit_id
    )


def project_to_mm(value):

    internal = UnitUtils.ConvertToInternalUnits(
        value,
        project_unit_id
    )

    return UnitUtils.ConvertFromInternalUnits(
        internal,
        UnitTypeId.Millimeters
    )


search_distance = mm_to_project(search_distance_mm)
collinear_tol = mm_to_project(collinear_tol_mm)


# ============================================================
# OUTILS GENERAUX
# ============================================================

def flatten(data):

    result = []

    if isinstance(data, (list, tuple)):

        for item in data:
            result.extend(flatten(item))

    elif data is not None:

        result.append(data)

    return result


wall_axes = flatten(wall_axes)


def xyz(point):

    return (
        float(point.X),
        float(point.Y),
        float(point.Z)
    )


def distance2d(a, b):

    dx = a[0] - b[0]
    dy = a[1] - b[1]

    return math.sqrt(
        dx * dx +
        dy * dy
    )


def dot2(a, b):

    return (
        a[0] * b[0] +
        a[1] * b[1]
    )


def normalize2(v):

    length = math.sqrt(
        v[0] * v[0] +
        v[1] * v[1]
    )

    if length <= 1e-12:
        return None

    return (
        v[0] / length,
        v[1] / length
    )


def get_info(info, key, default=None):

    try:
        return info[key]
    except:
        pass

    try:
        return info.get(key, default)
    except:
        return default


def make_point(p):

    return Point.ByCoordinates(
        p[0],
        p[1],
        p[2]
    )


def make_line(a, b):

    if distance2d(a, b) <= 1e-9:
        return None

    pa = make_point(a)
    pb = make_point(b)

    try:
        return Line.ByStartPointEndPoint(pa, pb)
    except:
        return None


# ============================================================
# MURS
# ============================================================

def wall_data(line, index):

    try:

        p0 = xyz(line.StartPoint)
        p1 = xyz(line.EndPoint)

    except:
        return None


    direction = normalize2(
        (
            p1[0] - p0[0],
            p1[1] - p0[1]
        )
    )


    if direction is None:
        return None


    return {

        "index": index,

        "line": line,

        "p0": p0,
        "p1": p1,

        "dir": direction,

        "length": distance2d(p0, p1)
    }


# ============================================================
# RECTANGLES
# ============================================================

def rectangle_data(rectangle):

    if not rectangle:
        return None


    if len(rectangle) < 4:
        return None


    # --------------------------------------------------------
    # Les 4 lignes produites par PORTE_01 sont ordonnées.
    # --------------------------------------------------------

    try:

        p0 = xyz(rectangle[0].StartPoint)
        p1 = xyz(rectangle[0].EndPoint)

        p2 = xyz(rectangle[1].EndPoint)
        p3 = xyz(rectangle[2].EndPoint)

    except:
        return None


    points = [
        p0,
        p1,
        p2,
        p3
    ]


    cx = sum(p[0] for p in points) / 4.0
    cy = sum(p[1] for p in points) / 4.0
    cz = sum(p[2] for p in points) / 4.0


    u = normalize2(
        (
            p1[0] - p0[0],
            p1[1] - p0[1]
        )
    )

    v = normalize2(
        (
            p2[0] - p1[0],
            p2[1] - p1[1]
        )
    )


    if u is None or v is None:
        return None


    size_u = distance2d(p0, p1)
    size_v = distance2d(p1, p2)


    return {

        "rectangle": rectangle,

        "points": points,

        "center": (
            cx,
            cy,
            cz
        ),

        "u": u,
        "v": v,

        "size_u": size_u,
        "size_v": size_v,

        "half_u": size_u * 0.5,
        "half_v": size_v * 0.5
    }


# ============================================================
# DISTANCE POINT -> RECTANGLE ORIENTE
# ============================================================

def point_rectangle_distance(point, rect):

    center = rect["center"]

    rel = (
        point[0] - center[0],
        point[1] - center[1]
    )


    local_u = dot2(
        rel,
        rect["u"]
    )

    local_v = dot2(
        rel,
        rect["v"]
    )


    du = max(
        abs(local_u) - rect["half_u"],
        0.0
    )

    dv = max(
        abs(local_v) - rect["half_v"],
        0.0
    )


    return math.sqrt(
        du * du +
        dv * dv
    )


# ============================================================
# INTERSECTION DROITE INFINIE / RECTANGLE
#
# Retourne :
#
# None
#
# ou
#
# {
#     "point1": ...
#     "point2": ...
#     "t1": ...
#     "t2": ...
# }
#
# Les deux points sont les deux intersections de la droite
# avec les côtés opposés du rectangle.
# ============================================================

def line_rectangle_intersections(
    point,
    direction,
    rect
):

    center = rect["center"]


    rel = (
        point[0] - center[0],
        point[1] - center[1]
    )


    # Point en repère rectangle
    pu = dot2(
        rel,
        rect["u"]
    )

    pv = dot2(
        rel,
        rect["v"]
    )


    # Direction en repère rectangle
    du = dot2(
        direction,
        rect["u"]
    )

    dv = dot2(
        direction,
        rect["v"]
    )


    t_min = float("-inf")
    t_max = float("inf")


    # ========================================================
    # SLAB U
    # ========================================================

    if abs(du) < 1e-12:

        if abs(pu) > rect["half_u"]:
            return None

    else:

        ta = (
            -rect["half_u"] - pu
        ) / du

        tb = (
            rect["half_u"] - pu
        ) / du


        if ta > tb:
            ta, tb = tb, ta


        t_min = max(t_min, ta)
        t_max = min(t_max, tb)


        if t_min > t_max:
            return None


    # ========================================================
    # SLAB V
    # ========================================================

    if abs(dv) < 1e-12:

        if abs(pv) > rect["half_v"]:
            return None

    else:

        ta = (
            -rect["half_v"] - pv
        ) / dv

        tb = (
            rect["half_v"] - pv
        ) / dv


        if ta > tb:
            ta, tb = tb, ta


        t_min = max(t_min, ta)
        t_max = min(t_max, tb)


        if t_min > t_max:
            return None


    if (
        not math.isfinite(t_min)
        or
        not math.isfinite(t_max)
    ):
        return None


    z = point[2]


    p1 = (

        point[0] +
        t_min * direction[0],

        point[1] +
        t_min * direction[1],

        z
    )


    p2 = (

        point[0] +
        t_max * direction[0],

        point[1] +
        t_max * direction[1],

        z
    )


    return {

        "point1": p1,
        "point2": p2,

        "t1": t_min,
        "t2": t_max
    }


# ============================================================
# ANGLE
# ============================================================

def angle_difference_deg(
    dir_a,
    dir_b
):

    value = abs(
        dot2(
            dir_a,
            dir_b
        )
    )


    value = max(
        0.0,
        min(
            1.0,
            value
        )
    )


    return math.degrees(
        math.acos(value)
    )


# ============================================================
# DISTANCE ENTRE DROITES SUPPORT
# ============================================================

def support_line_distance(
    wall_a,
    wall_b
):

    direction = wall_a["dir"]

    normal = (
        -direction[1],
        direction[0]
    )


    vector = (

        wall_b["p0"][0] -
        wall_a["p0"][0],

        wall_b["p0"][1] -
        wall_a["p0"][1]
    )


    return abs(
        dot2(
            vector,
            normal
        )
    )


# ============================================================
# EXTREMITE LA PLUS PROCHE DU RECTANGLE
# ============================================================

def closest_endpoint_to_rectangle(
    wall,
    rect
):

    d0 = point_rectangle_distance(
        wall["p0"],
        rect
    )

    d1 = point_rectangle_distance(
        wall["p1"],
        rect
    )


    if d0 <= d1:

        return {
            "point": wall["p0"],
            "distance": d0,
            "endpoint_id": 0
        }

    else:

        return {
            "point": wall["p1"],
            "distance": d1,
            "endpoint_id": 1
        }


# ============================================================
# COTE D'UNE EXTREMITE PAR RAPPORT AU CENTRE
# ============================================================

def signed_position(
    point,
    center,
    direction
):

    vector = (

        point[0] - center[0],
        point[1] - center[1]
    )


    return dot2(
        vector,
        direction
    )


# ============================================================
# POINT D'INTERSECTION OPPOSE A UNE EXTREMITE
#
# La droite coupe le rectangle en P1 et P2.
#
# On prend comme destination le point d'intersection
# le plus éloigné de l'extrémité existante.
# ============================================================

def opposite_rectangle_point(
    endpoint,
    intersections
):

    p1 = intersections["point1"]
    p2 = intersections["point2"]


    d1 = distance2d(
        endpoint,
        p1
    )

    d2 = distance2d(
        endpoint,
        p2
    )


    if d1 >= d2:
        return p1

    return p2


# ============================================================
# PREPARATION MURS
# ============================================================

walls = []


for i, axis in enumerate(wall_axes):

    data = wall_data(
        axis,
        i
    )


    if data is None:
        continue


    width_mm = None


    if i < len(wall_widths_mm):

        try:

            width_mm = float(
                wall_widths_mm[i]
            )

        except:
            pass


    data["width_mm"] = width_mm

    walls.append(data)


# ============================================================
# PREPARATION PORTES
# ============================================================

rectangles = []


for i, rectangle in enumerate(
    door_rectangles
):

    data = rectangle_data(
        rectangle
    )


    if data is None:
        continue


    data["index"] = i


    if i < len(door_infos):

        data["info"] = (
            door_infos[i]
        )

    else:

        data["info"] = None


    rectangles.append(data)


# ============================================================
# OUTPUTS
# ============================================================

wall_pairs = []

two_axis_connections = []

single_axis_extensions = []

associations = []

doors_without_solution = []

ambiguous_doors = []


# ============================================================
# DIAGNOSTIC
# ============================================================

doors_with_candidates = 0

doors_two_axes = 0
doors_one_axis = 0

doors_no_solution_count = 0

doors_ambiguous_count = 0

total_candidates = 0
max_candidates = 0

pair_tests = 0

single_extensions_created = 0


# ============================================================
# BOUCLE PORTES
# ============================================================

for rect in rectangles:

    center = rect["center"]


    # ========================================================
    # ETAPE 1
    # AXES CANDIDATS
    # ========================================================

    candidates = []


    for wall in walls:

        closest = (
            closest_endpoint_to_rectangle(
                wall,
                rect
            )
        )


        # ----------------------------------------------------
        # Extrémité suffisamment proche
        # ----------------------------------------------------

        if (
            closest["distance"] >
            search_distance
        ):
            continue


        # ----------------------------------------------------
        # Droite support traverse le rectangle
        # ----------------------------------------------------

        intersections = (
            line_rectangle_intersections(
                wall["p0"],
                wall["dir"],
                rect
            )
        )


        if intersections is None:
            continue


        candidates.append({

            "wall":
                wall,

            "endpoint":
                closest["point"],

            "endpoint_id":
                closest["endpoint_id"],

            "distance":
                closest["distance"],

            "intersections":
                intersections
        })


    total_candidates += len(candidates)

    max_candidates = max(
        max_candidates,
        len(candidates)
    )


    if candidates:
        doors_with_candidates += 1


    # ========================================================
    # ETAPE 2
    # CHERCHER UNE PAIRE DE DEUX AXES
    # ========================================================

    possible_pairs = []


    if len(candidates) >= 2:

        for i in range(len(candidates)):

            for j in range(
                i + 1,
                len(candidates)
            ):

                pair_tests += 1


                ca = candidates[i]
                cb = candidates[j]

                wa = ca["wall"]
                wb = cb["wall"]


                # --------------------------------------------
                # A. Angle
                # --------------------------------------------

                angle = angle_difference_deg(
                    wa["dir"],
                    wb["dir"]
                )


                if angle > angle_tol_deg:
                    continue


                # --------------------------------------------
                # B. Colinéarité
                # --------------------------------------------

                line_distance = (
                    support_line_distance(
                        wa,
                        wb
                    )
                )


                if (
                    line_distance >
                    collinear_tol
                ):
                    continue


                # --------------------------------------------
                # C. Axes de part et d'autre de la porte
                # --------------------------------------------

                sa = signed_position(
                    ca["endpoint"],
                    center,
                    wa["dir"]
                )

                sb = signed_position(
                    cb["endpoint"],
                    center,
                    wa["dir"]
                )


                if sa * sb >= 0.0:
                    continue


                # --------------------------------------------
                # D. Gap entre extrémités
                # --------------------------------------------

                gap = distance2d(
                    ca["endpoint"],
                    cb["endpoint"]
                )


                # --------------------------------------------
                # E. Score
                # --------------------------------------------

                score = (

                    ca["distance"] +
                    cb["distance"] +

                    2.0 *
                    line_distance +

                    mm_to_project(
                        angle * 10.0
                    )
                )


                possible_pairs.append({

                    "a": ca,
                    "b": cb,

                    "angle": angle,

                    "line_distance":
                        line_distance,

                    "gap":
                        gap,

                    "score":
                        score
                })


    # ========================================================
    # CAS A
    # UNE PAIRE DE DEUX AXES EXISTE
    # ========================================================

    if possible_pairs:

        possible_pairs.sort(
            key=lambda x:
                x["score"]
        )


        best = possible_pairs[0]


        ambiguous = False


        if len(possible_pairs) > 1:

            second = possible_pairs[1]

            score_difference = (
                second["score"] -
                best["score"]
            )


            if (
                score_difference <
                mm_to_project(50.0)
            ):

                ambiguous = True


        ca = best["a"]
        cb = best["b"]

        wa = ca["wall"]
        wb = cb["wall"]


        connection = make_line(
            ca["endpoint"],
            cb["endpoint"]
        )


        if connection is not None:

            two_axis_connections.append(
                connection
            )


        wall_pairs.append([
            wa["line"],
            wb["line"]
        ])


        association = {

            "PorteIndex":
                rect["index"],

            "Mode":
                "DeuxAxes",

            "MurA":
                wa["index"],

            "MurB":
                wb["index"],

            "DistanceA_mm":
                round(
                    project_to_mm(
                        ca["distance"]
                    ),
                    1
                ),

            "DistanceB_mm":
                round(
                    project_to_mm(
                        cb["distance"]
                    ),
                    1
                ),

            "AngleDifference_deg":
                round(
                    best["angle"],
                    3
                ),

            "DecalageAxes_mm":
                round(
                    project_to_mm(
                        best[
                            "line_distance"
                        ]
                    ),
                    1
                ),

            "Gap_mm":
                round(
                    project_to_mm(
                        best["gap"]
                    ),
                    1
                ),

            "NbAxesCandidats":
                len(candidates),

            "NbPairesPossibles":
                len(possible_pairs),

            "Ambigu":
                ambiguous
        }


        associations.append(
            association
        )


        doors_two_axes += 1


        if ambiguous:

            doors_ambiguous_count += 1

            ambiguous_doors.append(
                rect["rectangle"]
            )


        # Porte traitée :
        # on ne crée PAS de prolongement simple.
        continue


    # ========================================================
    # CAS B
    # PAS DE PAIRE
    #
    # On cherche maintenant le meilleur axe individuel.
    # ========================================================

    if candidates:

        # ----------------------------------------------------
        # Axe dont l'extrémité est la plus proche
        # du rectangle.
        # ----------------------------------------------------

        candidates.sort(
            key=lambda x:
                x["distance"]
        )


        best = candidates[0]


        wall = best["wall"]

        endpoint = best["endpoint"]


        # ----------------------------------------------------
        # Point situé sur le côté opposé du rectangle.
        # ----------------------------------------------------

        destination = (
            opposite_rectangle_point(
                endpoint,
                best["intersections"]
            )
        )


        extension = make_line(
            endpoint,
            destination
        )


        if extension is not None:

            single_axis_extensions.append(
                extension
            )

            single_extensions_created += 1


            association = {

                "PorteIndex":
                    rect["index"],

                "Mode":
                    "UnAxe",

                "MurA":
                    wall["index"],

                "MurB":
                    None,

                "DistanceA_mm":
                    round(
                        project_to_mm(
                            best["distance"]
                        ),
                        1
                    ),

                "LongueurProlongement_mm":
                    round(
                        project_to_mm(
                            distance2d(
                                endpoint,
                                destination
                            )
                        ),
                        1
                    ),

                "NbAxesCandidats":
                    len(candidates),

                "Ambigu":
                    False
            }


            associations.append(
                association
            )


            doors_one_axis += 1

            continue


    # ========================================================
    # CAS C
    # AUCUNE SOLUTION
    # ========================================================

    doors_without_solution.append(
        rect["rectangle"]
    )

    doors_no_solution_count += 1


# ============================================================
# DIAGNOSTIC
# ============================================================

diagnostic = {

    "Axes murs entree":
        len(wall_axes),

    "Axes murs valides":
        len(walls),

    "Portes entree":
        len(door_rectangles),

    "Rectangles valides":
        len(rectangles),

    "Portes avec axes candidats":
        doors_with_candidates,

    "Portes mode DeuxAxes":
        doors_two_axes,

    "Portes mode UnAxe":
        doors_one_axis,

    "Portes sans solution":
        doors_no_solution_count,

    "Portes ambigues":
        doors_ambiguous_count,

    "Axes candidats total":
        total_candidates,

    "Nb axes candidats max":
        max_candidates,

    "Tests de paires":
        pair_tests,

    "Prolongements simples crees":
        single_extensions_created,

    "Distance recherche mm":
        search_distance_mm,

    "Tolerance colinearite mm":
        collinear_tol_mm,

    "Tolerance angle deg":
        angle_tol_deg
}


# ============================================================
# OUTPUT
# ============================================================

OUT = (

    wall_pairs,               # OUT[0]

    two_axis_connections,     # OUT[1]

    single_axis_extensions,   # OUT[2]

    associations,             # OUT[3]

    doors_without_solution,   # OUT[4]

    ambiguous_doors,          # OUT[5]

    diagnostic                # OUT[6]
)
# ----------------------------------------
code_block_9 = CodeBlock(x=MUR_04_AssocierPortesAxes) { x[1]; x[2]; x[3]; }
MUR_05_ReconstituerAxes = Python(IN[0]=code_block_6.out0, IN[1]=code_block_6.out1, IN[2]=code_block_9.out0, IN[3]=code_block_9.out1, IN[4]=code_block_9.out2)  # PythonNet3; unwired: IN[5], IN[6], IN[7], IN[8]
# ---------- MUR_05_ReconstituerAxes.python (1522 lines) ----------
# -*- coding: utf-8 -*-

import clr
import math

clr.AddReference("ProtoGeometry")
from Autodesk.DesignScript.Geometry import Point, Line

clr.AddReference("RevitAPI")
from Autodesk.Revit.DB import UnitUtils, UnitTypeId, SpecTypeId

clr.AddReference("RevitServices")
from RevitServices.Persistence import DocumentManager


# ============================================================
# MUR_05_ReconstituerAxes
#
# Objectif :
#
# 1. Partir des axes MUR_03
#
# 2. Appliquer les corrections validées de MUR_04 :
#
#       DeuxAxes :
#       A ------    ------ B
#              \__/
#              porte
#
#       => A et B peuvent être reconstruits ensemble
#
#
#       UnAxe :
#       A ------ [porte]
#
#       => prolonger A uniquement
#
#
# 3. Fusionner les segments :
#       - parallèles
#       - colinéaires
#       - épaisseur compatible
#       - overlap ou petit gap
#
# 4. Les prolongements UnAxe restent conservateurs :
#    ils modifient uniquement leur axe source.
#
# 5. Les associations ambiguës de MUR_04 sont ignorées.
#
# ============================================================


# ============================================================
# INPUTS
# ============================================================

input_axes = IN[0] if IN[0] else []
input_widths = IN[1] if IN[1] else []

two_axis_connections = IN[2] if IN[2] else []
single_axis_extensions = IN[3] if IN[3] else []
associations = IN[4] if IN[4] else []


angle_tol_deg = (
    float(IN[5])
    if IN[5] is not None
    else 0.5
)

collinear_tol_mm = (
    float(IN[6])
    if IN[6] is not None
    else 5.0
)

gap_tol_mm = (
    float(IN[7])
    if IN[7] is not None
    else 5.0
)

width_tol_mm = (
    float(IN[8])
    if IN[8] is not None
    else 5.0
)


# ============================================================
# FLATTEN
# ============================================================

def flatten(data):

    result = []

    if isinstance(data, (list, tuple)):

        for item in data:
            result.extend(flatten(item))

    elif data is not None:

        result.append(data)

    return result


axes = flatten(input_axes)

two_axis_connections = flatten(
    two_axis_connections
)

single_axis_extensions = flatten(
    single_axis_extensions
)


# ============================================================
# UNITES
# ============================================================

doc = DocumentManager.Instance.CurrentDBDocument

project_unit_id = (
    doc.GetUnits()
       .GetFormatOptions(SpecTypeId.Length)
       .GetUnitTypeId()
)


def mm_to_project(value_mm):

    internal = UnitUtils.ConvertToInternalUnits(
        value_mm,
        UnitTypeId.Millimeters
    )

    return UnitUtils.ConvertFromInternalUnits(
        internal,
        project_unit_id
    )


def project_to_mm(value):

    internal = UnitUtils.ConvertToInternalUnits(
        value,
        project_unit_id
    )

    return UnitUtils.ConvertFromInternalUnits(
        internal,
        UnitTypeId.Millimeters
    )


collinear_tol = mm_to_project(
    collinear_tol_mm
)

gap_tol = mm_to_project(
    gap_tol_mm
)


# ============================================================
# OUTILS
# ============================================================

def xyz(point):

    return (
        float(point.X),
        float(point.Y),
        float(point.Z)
    )


def distance2d(a, b):

    dx = a[0] - b[0]
    dy = a[1] - b[1]

    return math.sqrt(
        dx * dx +
        dy * dy
    )


def dot2(a, b):

    return (
        a[0] * b[0] +
        a[1] * b[1]
    )


def normalize2(v):

    length = math.sqrt(
        v[0] * v[0] +
        v[1] * v[1]
    )

    if length <= 1e-12:
        return None

    return (
        v[0] / length,
        v[1] / length
    )


def get_info(info, key, default=None):

    try:
        return info[key]
    except:
        pass

    try:
        return info.get(key, default)
    except:
        return default


def make_line(a, b):

    if distance2d(a, b) <= 1e-9:
        return None

    pa = Point.ByCoordinates(
        a[0],
        a[1],
        a[2]
    )

    pb = Point.ByCoordinates(
        b[0],
        b[1],
        b[2]
    )

    try:

        return Line.ByStartPointEndPoint(
            pa,
            pb
        )

    except:

        return None


# ============================================================
# DONNEES D'UN AXE
# ============================================================

def curve_data(curve):

    try:

        p0 = xyz(curve.StartPoint)
        p1 = xyz(curve.EndPoint)

    except:

        return None


    direction = normalize2(
        (
            p1[0] - p0[0],
            p1[1] - p0[1]
        )
    )


    if direction is None:
        return None


    return {

        "p0": p0,
        "p1": p1,

        "dir": direction,

        "length": distance2d(
            p0,
            p1
        )
    }


# ============================================================
# ANGLE ENTRE DIRECTIONS
#
# Sans sens :
# +X et -X sont considérés parallèles.
# ============================================================

def angle_difference_deg(a, b):

    value = abs(
        dot2(a, b)
    )

    value = max(
        0.0,
        min(1.0, value)
    )

    return math.degrees(
        math.acos(value)
    )


# ============================================================
# DISTANCE ENTRE DROITES SUPPORT
# ============================================================

def support_distance(
    data_a,
    data_b
):

    direction = data_a["dir"]

    normal = (
        -direction[1],
        direction[0]
    )

    vector = (
        data_b["p0"][0] -
        data_a["p0"][0],

        data_b["p0"][1] -
        data_a["p0"][1]
    )

    return abs(
        dot2(
            vector,
            normal
        )
    )


# ============================================================
# PROJECTION D'UN SEGMENT SUR UNE DIRECTION
# ============================================================

def projection_interval(
    data,
    direction
):

    s0 = dot2(
        (
            data["p0"][0],
            data["p0"][1]
        ),
        direction
    )

    s1 = dot2(
        (
            data["p1"][0],
            data["p1"][1]
        ),
        direction
    )

    return (
        min(s0, s1),
        max(s0, s1)
    )


# ============================================================
# GAP ENTRE DEUX INTERVALLES
#
# gap > 0  : espace
# gap = 0  : contact
# gap < 0  : overlap
# ============================================================

def interval_gap(a, b):

    a0, a1 = a
    b0, b1 = b

    if a1 < b0:
        return b0 - a1

    if b1 < a0:
        return a0 - b1

    overlap = min(
        a1,
        b1
    ) - max(
        a0,
        b0
    )

    return -overlap


# ============================================================
# POINT DE LA DROITE A UNE COORDONNEE PROJETEE s
# ============================================================

def point_at_projection(
    reference,
    direction,
    s
):

    p = reference["p0"]

    p_s = dot2(
        (
            p[0],
            p[1]
        ),
        direction
    )

    delta = s - p_s

    return (
        p[0] +
        delta * direction[0],

        p[1] +
        delta * direction[1],

        p[2]
    )


# ============================================================
# FUSION GEOMETRIQUE DE DEUX SEGMENTS
# ============================================================

def merge_two_segments(
    data_a,
    data_b
):

    direction = data_a["dir"]

    ia = projection_interval(
        data_a,
        direction
    )

    ib = projection_interval(
        data_b,
        direction
    )


    s_min = min(
        ia[0],
        ib[0]
    )

    s_max = max(
        ia[1],
        ib[1]
    )


    p0 = point_at_projection(
        data_a,
        direction,
        s_min
    )

    p1 = point_at_projection(
        data_a,
        direction,
        s_max
    )


    return make_line(
        p0,
        p1
    )


# ============================================================
# COMPATIBILITE DE DEUX AXES
# ============================================================

def can_merge(
    axis_a,
    axis_b
):

    da = curve_data(
        axis_a["curve"]
    )

    db = curve_data(
        axis_b["curve"]
    )


    if da is None or db is None:
        return False, None


    # --------------------------------------------------------
    # 1. Parallélisme
    # --------------------------------------------------------

    angle = angle_difference_deg(
        da["dir"],
        db["dir"]
    )


    if angle > angle_tol_deg:
        return False, None


    # --------------------------------------------------------
    # 2. Colinéarité
    # --------------------------------------------------------

    offset = support_distance(
        da,
        db
    )


    if offset > collinear_tol:
        return False, None


    # --------------------------------------------------------
    # 3. Epaisseur
    # --------------------------------------------------------

    wa = axis_a["width_mm"]
    wb = axis_b["width_mm"]


    if (
        wa is not None
        and
        wb is not None
    ):

        if abs(wa - wb) > width_tol_mm:
            return False, None


    # --------------------------------------------------------
    # 4. Overlap / gap
    # --------------------------------------------------------

    ia = projection_interval(
        da,
        da["dir"]
    )

    ib = projection_interval(
        db,
        da["dir"]
    )


    gap = interval_gap(
        ia,
        ib
    )


    if gap > gap_tol:
        return False, None


    return True, {

        "angle_deg":
            angle,

        "offset":
            offset,

        "gap":
            gap
    }


# ============================================================
# AXES DE BASE
# ============================================================

records = []


for i, curve in enumerate(axes):

    data = curve_data(curve)

    if data is None:
        continue


    width = None


    if i < len(input_widths):

        try:
            width = float(
                input_widths[i]
            )
        except:
            pass


    records.append({

        "curve":
            curve,

        "width_mm":
            width,

        "sources":
            [i],

        "modified":
            False,

        "door_two_axis":
            False,

        "door_single_axis":
            False
    })


# ============================================================
# INDEX MUR_03 -> RECORD
# ============================================================

record_by_source = {}

for record in records:

    if len(record["sources"]) == 1:

        record_by_source[
            record["sources"][0]
        ] = record


# ============================================================
# ASSOCIATIONS MUR_04
#
# Séparer :
#
# - DeuxAxes valides
# - DeuxAxes ambiguës
# - UnAxe
#
# ============================================================

valid_two_axis_assoc = []

ambiguous_two_axis_assoc = []

single_axis_assoc = []


for assoc in associations:

    mode = get_info(
        assoc,
        "Mode",
        None
    )

    ambiguous = bool(
        get_info(
            assoc,
            "Ambigu",
            False
        )
    )


    if mode == "DeuxAxes":

        if ambiguous:

            ambiguous_two_axis_assoc.append(
                assoc
            )

        else:

            valid_two_axis_assoc.append(
                assoc
            )


    elif mode == "UnAxe":

        single_axis_assoc.append(
            assoc
        )


# ============================================================
# ETAPE 1
# DEUX AXES VALIDES
#
# On fusionne directement les deux axes sources.
#
# On ne dépend PAS de l'ordre de OUT[1].
# On utilise MurA / MurB des associations.
# ============================================================

two_axis_merges_done = 0

two_axis_failed = 0

removed_record_ids = set()


for assoc in valid_two_axis_assoc:

    mur_a = get_info(
        assoc,
        "MurA",
        None
    )

    mur_b = get_info(
        assoc,
        "MurB",
        None
    )


    if (
        mur_a is None
        or
        mur_b is None
    ):

        two_axis_failed += 1
        continue


    record_a = record_by_source.get(
        mur_a
    )

    record_b = record_by_source.get(
        mur_b
    )


    if (
        record_a is None
        or
        record_b is None
    ):

        two_axis_failed += 1
        continue


    da = curve_data(
        record_a["curve"]
    )

    db = curve_data(
        record_b["curve"]
    )


    if da is None or db is None:

        two_axis_failed += 1
        continue


    # --------------------------------------------------------
    # Vérification minimale :
    # parallèles + colinéaires
    #
    # Le gap peut être grand car il contient justement
    # la porte.
    # --------------------------------------------------------

    angle = angle_difference_deg(
        da["dir"],
        db["dir"]
    )

    offset = support_distance(
        da,
        db
    )


    if (
        angle > angle_tol_deg
        or
        offset > collinear_tol
    ):

        two_axis_failed += 1
        continue


    # --------------------------------------------------------
    # Epaisseur compatible
    # --------------------------------------------------------

    wa = record_a["width_mm"]
    wb = record_b["width_mm"]


    if (
        wa is not None
        and
        wb is not None
        and
        abs(wa - wb) >
        width_tol_mm
    ):

        two_axis_failed += 1
        continue


    merged_curve = merge_two_segments(
        da,
        db
    )


    if merged_curve is None:

        two_axis_failed += 1
        continue


    # --------------------------------------------------------
    # Epaisseur résultante
    # --------------------------------------------------------

    if (
        wa is not None
        and
        wb is not None
    ):

        merged_width = (
            wa + wb
        ) * 0.5

    elif wa is not None:

        merged_width = wa

    else:

        merged_width = wb


    new_record = {

        "curve":
            merged_curve,

        "width_mm":
            merged_width,

        "sources":
            record_a["sources"] +
            record_b["sources"],

        "modified":
            True,

        "door_two_axis":
            True,

        "door_single_axis":
            False
    }


    removed_record_ids.add(
        id(record_a)
    )

    removed_record_ids.add(
        id(record_b)
    )


    records.append(
        new_record
    )


    # Les deux anciens records ne doivent plus
    # être utilisés par source.
    record_by_source[mur_a] = new_record
    record_by_source[mur_b] = new_record


    two_axis_merges_done += 1


# ============================================================
# SUPPRIMER LES RECORDS REMPLACES
# ============================================================

records = [

    record

    for record in records

    if id(record)
    not in removed_record_ids
]


# ============================================================
# ETAPE 2
# PROLONGEMENTS UN AXE
#
# Ici nous utilisons l'association MurA pour retrouver
# l'axe source.
#
# On cherche ensuite dans OUT[2] la géométrie de prolongement
# correspondante par proximité.
#
# ============================================================

def closest_extension_to_axis(
    axis_curve,
    extensions
):

    data = curve_data(
        axis_curve
    )

    if data is None:
        return None


    best = None
    best_distance = None


    for ext in extensions:

        edata = curve_data(ext)

        if edata is None:
            continue


        # ----------------------------------------------------
        # Direction compatible
        # ----------------------------------------------------

        angle = angle_difference_deg(
            data["dir"],
            edata["dir"]
        )


        if angle > angle_tol_deg:
            continue


        # ----------------------------------------------------
        # Droites support compatibles
        # ----------------------------------------------------

        offset = support_distance(
            data,
            edata
        )


        if offset > collinear_tol:
            continue


        # ----------------------------------------------------
        # Une extrémité de l'extension doit être proche
        # d'une extrémité de l'axe.
        # ----------------------------------------------------

        d = min(

            distance2d(
                data["p0"],
                edata["p0"]
            ),

            distance2d(
                data["p0"],
                edata["p1"]
            ),

            distance2d(
                data["p1"],
                edata["p0"]
            ),

            distance2d(
                data["p1"],
                edata["p1"]
            )
        )


        if (
            best is None
            or
            d < best_distance
        ):

            best = ext
            best_distance = d


    return best


single_axis_done = 0
single_axis_failed = 0

used_extensions = set()


for assoc in single_axis_assoc:

    mur_a = get_info(
        assoc,
        "MurA",
        None
    )


    if mur_a is None:

        single_axis_failed += 1
        continue


    record = record_by_source.get(
        mur_a
    )


    if record is None:

        single_axis_failed += 1
        continue


    # --------------------------------------------------------
    # Si l'axe a déjà été fusionné par une association
    # DeuxAxes, on ne lui applique pas automatiquement
    # un prolongement UnAxe.
    # --------------------------------------------------------

    if record["door_two_axis"]:

        single_axis_failed += 1
        continue


    available_extensions = [

        ext

        for ext in single_axis_extensions

        if id(ext)
        not in used_extensions
    ]


    extension = closest_extension_to_axis(
        record["curve"],
        available_extensions
    )


    if extension is None:

        single_axis_failed += 1
        continue


    da = curve_data(
        record["curve"]
    )

    de = curve_data(
        extension
    )


    merged_curve = merge_two_segments(
        da,
        de
    )


    if merged_curve is None:

        single_axis_failed += 1
        continue


    record["curve"] = merged_curve

    record["modified"] = True

    record["door_single_axis"] = True


    used_extensions.add(
        id(extension)
    )


    single_axis_done += 1


# ============================================================
# ETAPE 3
# FUSION GENERALE DES AXES COLINEAIRES
#
# IMPORTANT :
#
# Les axes issus de "UnAxe" ne doivent pas déclencher
# une fusion automatique avec un autre axe.
#
# Ils peuvent être prolongés, mais restent isolés.
#
# Cela évite :
#
#    axe ---- [porte] ======= autre axe
#
# alors que MUR_04 n'avait pas validé cet autre axe.
# ============================================================

general_merges = 0

changed = True


while changed:

    changed = False

    n = len(records)


    for i in range(n):

        if changed:
            break


        a = records[i]


        # UnAxe = pas de fusion en chaîne
        if a["door_single_axis"]:
            continue


        for j in range(
            i + 1,
            n
        ):

            b = records[j]


            if b["door_single_axis"]:
                continue


            compatible, info = can_merge(
                a,
                b
            )


            if not compatible:
                continue


            da = curve_data(
                a["curve"]
            )

            db = curve_data(
                b["curve"]
            )


            merged_curve = merge_two_segments(
                da,
                db
            )


            if merged_curve is None:
                continue


            # ------------------------------------------------
            # Epaisseur
            # ------------------------------------------------

            wa = a["width_mm"]
            wb = b["width_mm"]


            if (
                wa is not None
                and
                wb is not None
            ):

                # Pondération par longueur
                la = da["length"]
                lb = db["length"]

                if la + lb > 1e-12:

                    width = (
                        wa * la +
                        wb * lb
                    ) / (
                        la + lb
                    )

                else:

                    width = (
                        wa + wb
                    ) * 0.5

            elif wa is not None:

                width = wa

            else:

                width = wb


            merged_record = {

                "curve":
                    merged_curve,

                "width_mm":
                    width,

                "sources":
                    a["sources"] +
                    b["sources"],

                "modified":
                    True,

                "door_two_axis":
                    (
                        a["door_two_axis"]
                        or
                        b["door_two_axis"]
                    ),

                "door_single_axis":
                    False
            }


            # ------------------------------------------------
            # Remplacer A et B
            # ------------------------------------------------

            new_records = []


            for k, record in enumerate(
                records
            ):

                if k == i or k == j:
                    continue

                new_records.append(
                    record
                )


            new_records.append(
                merged_record
            )

            records = new_records


            general_merges += 1

            changed = True

            break


# ============================================================
# OUTPUT FINAL
# ============================================================

final_axes = []

final_widths = []

modified_axes = []

unmodified_axes = []

axis_infos = []


for index, record in enumerate(
    records
):

    curve = record["curve"]

    data = curve_data(curve)


    if data is None:
        continue


    final_axes.append(
        curve
    )

    final_widths.append(
        record["width_mm"]
    )


    if record["modified"]:

        modified_axes.append(
            curve
        )

    else:

        unmodified_axes.append(
            curve
        )


    axis_infos.append({

        "IndexFinal":
            index,

        "SourcesMUR03":
            record["sources"],

        "NbSources":
            len(
                record["sources"]
            ),

        "Epaisseur_mm":
            (
                round(
                    record["width_mm"],
                    2
                )
                if
                record["width_mm"]
                is not None
                else None
            ),

        "Longueur_mm":
            round(
                project_to_mm(
                    data["length"]
                ),
                1
            ),

        "Modifie":
            record["modified"],

        "ConnexionPorteDeuxAxes":
            record["door_two_axis"],

        "ProlongementPorteUnAxe":
            record["door_single_axis"]
    })


# ============================================================
# DIAGNOSTIC
# ============================================================

diagnostic = {

    "Axes MUR03 entree":
        len(axes),

    "Axes MUR03 valides":
        len([
            x for x in axes
            if curve_data(x) is not None
        ]),

    "Associations DeuxAxes valides":
        len(valid_two_axis_assoc),

    "Associations DeuxAxes ambigues ignorees":
        len(ambiguous_two_axis_assoc),

    "Fusions DeuxAxes effectuees":
        two_axis_merges_done,

    "Fusions DeuxAxes echouees":
        two_axis_failed,

    "Associations UnAxe":
        len(single_axis_assoc),

    "Prolongements UnAxe appliques":
        single_axis_done,

    "Prolongements UnAxe non appliques":
        single_axis_failed,

    "Fusions generales":
        general_merges,

    "Axes finaux":
        len(final_axes),

    "Axes modifies":
        len(modified_axes),

    "Axes non modifies":
        len(unmodified_axes),

    "Tolerance angle deg":
        angle_tol_deg,

    "Tolerance colinearite mm":
        collinear_tol_mm,

    "Tolerance gap mm":
        gap_tol_mm,

    "Tolerance epaisseur mm":
        width_tol_mm
}


# ============================================================
# OUTPUT
# ============================================================

OUT = (

    final_axes,          # OUT[0]

    final_widths,        # OUT[1]

    modified_axes,       # OUT[2]

    unmodified_axes,     # OUT[3]

    axis_infos,          # OUT[4]

    diagnostic           # OUT[5]
)
# ----------------------------------------
code_block_10 = CodeBlock(x=MUR_05_ReconstituerAxes) { x[0]; x[1]; }
MUR_06_ResoudreJonctions = Python(IN[0]=code_block_10.out0, IN[1]=code_block_10.out1)  # PythonNet3; unwired: IN[2], IN[3]
# ---------- MUR_06_ResoudreJonctions.python (1461 lines) ----------
# -*- coding: utf-8 -*-

import clr
import math

clr.AddReference("ProtoGeometry")
from Autodesk.DesignScript.Geometry import Point, Line

clr.AddReference("RevitAPI")
from Autodesk.Revit.DB import UnitUtils, UnitTypeId, SpecTypeId

clr.AddReference("RevitServices")
from RevitServices.Persistence import DocumentManager


# ============================================================
# MUR_06_ResoudreJonctions
#
# Entrées :
#
# IN[0] = axes MUR_05
# IN[1] = épaisseurs mm
# IN[2] = tolérance jonction mm       (ex. 20)
# IN[3] = tolérance angle deg         (ex. 2)
#
#
# Détection :
#
# L :
#
#       A ----●
#             |
#             |
#             B
#
# intersection proche d'une extrémité
# de A ET d'une extrémité de B.
#
#
# T :
#
#       A -------------
#             |
#             ● B
#
# intersection dans A
# + proche d'une extrémité de B.
#
#
# X :
#
#             B
#             |
#       ------+------
#             |
#
# intersection intérieure aux deux axes.
#
#
# IMPORTANT :
#
# - Pas de découpe des axes aux T/X.
# - Correction seulement si l'extrémité est
#   <= tolérance jonction de l'intersection.
# - Pas de correction d'intersections éloignées.
# - Les axes presque parallèles sont ignorés.
#
# ============================================================


# ============================================================
# INPUTS
# ============================================================

input_axes = IN[0] if IN[0] else []
input_widths = IN[1] if IN[1] else []

junction_tol_mm = (
    float(IN[2])
    if IN[2] is not None
    else 2
)

angle_tol_deg = (
    float(IN[3])
    if IN[3] is not None
    else 2.0
)


# ============================================================
# FLATTEN
# ============================================================

def flatten(data):

    result = []

    if isinstance(data, (list, tuple)):

        for item in data:
            result.extend(flatten(item))

    elif data is not None:

        result.append(data)

    return result


axes = flatten(input_axes)


# ============================================================
# UNITES
# ============================================================

doc = DocumentManager.Instance.CurrentDBDocument

project_unit_id = (
    doc.GetUnits()
       .GetFormatOptions(SpecTypeId.Length)
       .GetUnitTypeId()
)


def mm_to_project(value_mm):

    internal = UnitUtils.ConvertToInternalUnits(
        value_mm,
        UnitTypeId.Millimeters
    )

    return UnitUtils.ConvertFromInternalUnits(
        internal,
        project_unit_id
    )


def project_to_mm(value):

    internal = UnitUtils.ConvertToInternalUnits(
        value,
        project_unit_id
    )

    return UnitUtils.ConvertFromInternalUnits(
        internal,
        UnitTypeId.Millimeters
    )


junction_tol = mm_to_project(
    junction_tol_mm
)


# ============================================================
# OUTILS GEOMETRIQUES
# ============================================================

EPS = 1e-9


def xyz(point):

    return (
        float(point.X),
        float(point.Y),
        float(point.Z)
    )


def distance2d(a, b):

    dx = a[0] - b[0]
    dy = a[1] - b[1]

    return math.sqrt(
        dx * dx +
        dy * dy
    )


def dot2(a, b):

    return (
        a[0] * b[0] +
        a[1] * b[1]
    )


def cross2(a, b):

    return (
        a[0] * b[1]
        -
        a[1] * b[0]
    )


def normalize2(v):

    length = math.sqrt(
        v[0] * v[0]
        +
        v[1] * v[1]
    )

    if length <= EPS:
        return None

    return (
        v[0] / length,
        v[1] / length
    )


def make_point(p):

    try:

        return Point.ByCoordinates(
            p[0],
            p[1],
            p[2]
        )

    except:

        return None


def make_line(a, b):

    if distance2d(a, b) <= EPS:
        return None

    pa = make_point(a)
    pb = make_point(b)

    if pa is None or pb is None:
        return None

    try:

        return Line.ByStartPointEndPoint(
            pa,
            pb
        )

    except:

        return None


# ============================================================
# DONNEES AXE
# ============================================================

def curve_data(curve):

    try:

        p0 = xyz(curve.StartPoint)
        p1 = xyz(curve.EndPoint)

    except:

        return None


    dx = p1[0] - p0[0]
    dy = p1[1] - p0[1]

    length = math.sqrt(
        dx * dx +
        dy * dy
    )


    if length <= EPS:
        return None


    direction = (
        dx / length,
        dy / length
    )


    return {

        "p0": p0,
        "p1": p1,

        "dir": direction,

        "length": length
    }


# ============================================================
# ANGLE ENTRE DEUX AXES
#
# Retour 0..90°
#
# 0°  = parallèles
# 90° = perpendiculaires
# ============================================================

def acute_angle_deg(dir_a, dir_b):

    value = abs(
        dot2(
            dir_a,
            dir_b
        )
    )

    value = max(
        0.0,
        min(
            1.0,
            value
        )
    )

    return math.degrees(
        math.acos(value)
    )


# ============================================================
# INTERSECTION DES DEUX DROITES SUPPORT
#
# A :
# P + t*r
#
# B :
# Q + u*s
#
# Retour :
#
# point
# t
# u
#
# t=0 -> début A
# t=1 -> fin A
#
# u=0 -> début B
# u=1 -> fin B
# ============================================================

def support_intersection(data_a, data_b):

    p = data_a["p0"]
    q = data_b["p0"]

    r = (
        data_a["p1"][0] - p[0],
        data_a["p1"][1] - p[1]
    )

    s = (
        data_b["p1"][0] - q[0],
        data_b["p1"][1] - q[1]
    )


    denominator = cross2(
        r,
        s
    )


    if abs(denominator) <= EPS:
        return None


    qp = (
        q[0] - p[0],
        q[1] - p[1]
    )


    t = (
        cross2(qp, s)
        /
        denominator
    )

    u = (
        cross2(qp, r)
        /
        denominator
    )


    x = (
        p[0]
        +
        t * r[0]
    )

    y = (
        p[1]
        +
        t * r[1]
    )


    # Tous les axes du plan sont supposés
    # être dans le même plan Z.
    z = (
        p[2] +
        q[2]
    ) * 0.5


    return {

        "point": (
            x,
            y,
            z
        ),

        "t": t,
        "u": u
    }


# ============================================================
# CLASSIFICATION DE LA POSITION D'UNE INTERSECTION
# PAR RAPPORT A UN SEGMENT
#
# endpoint :
# intersection <= tol d'une extrémité
#
# interior :
# intersection réellement dans le segment
#
# outside :
# hors segment et trop loin des extrémités
#
#
# On utilise ici les distances réelles plutôt que seulement
# t afin que la tolérance soit exprimée en mm.
# ============================================================

def classify_on_segment(
    data,
    intersection_point
):

    p0 = data["p0"]
    p1 = data["p1"]


    d0 = distance2d(
        intersection_point,
        p0
    )

    d1 = distance2d(
        intersection_point,
        p1
    )


    # --------------------------------------------------------
    # Proche d'une extrémité
    # --------------------------------------------------------

    if (
        d0 <= junction_tol
        or
        d1 <= junction_tol
    ):

        if d0 <= d1:

            return {

                "type":
                    "endpoint",

                "endpoint_id":
                    0,

                "distance":
                    d0
            }

        else:

            return {

                "type":
                    "endpoint",

                "endpoint_id":
                    1,

                "distance":
                    d1
            }


    # --------------------------------------------------------
    # Projection sur segment
    # --------------------------------------------------------

    vector = (
        intersection_point[0] - p0[0],
        intersection_point[1] - p0[1]
    )


    projection = dot2(
        vector,
        data["dir"]
    )


    if (
        projection > 0.0
        and
        projection < data["length"]
    ):

        return {

            "type":
                "interior",

            "endpoint_id":
                None,

            "distance":
                0.0
        }


    # --------------------------------------------------------
    # Hors segment
    # --------------------------------------------------------

    return {

        "type":
            "outside",

        "endpoint_id":
            None,

        "distance":
            min(d0, d1)
    }


# ============================================================
# PREPARATION DES AXES
# ============================================================

records = []


for i, curve in enumerate(axes):

    data = curve_data(curve)

    if data is None:
        continue


    width = None

    if i < len(input_widths):

        try:
            width = float(
                input_widths[i]
            )
        except:
            pass


    records.append({

        "index":
            i,

        "curve":
            curve,

        "p0":
            data["p0"],

        "p1":
            data["p1"],

        "width_mm":
            width,

        "modified":
            False,

        "corrections":
            []
    })


# ============================================================
# PREMIERE PASSE :
# DETECTER LES JONCTIONS SUR LA GEOMETRIE INITIALE
#
# Très important :
#
# On détecte toutes les relations AVANT de modifier les axes.
# Sinon une correction précédente pourrait influencer la
# détection d'une paire suivante.
# ============================================================

junctions = []


ignored_parallel = 0
ignored_far = 0
ignored_invalid = 0

pair_tests = 0


for i in range(len(records)):

    for j in range(
        i + 1,
        len(records)
    ):

        pair_tests += 1


        rec_a = records[i]
        rec_b = records[j]


        da = curve_data(
            rec_a["curve"]
        )

        db = curve_data(
            rec_b["curve"]
        )


        if da is None or db is None:

            ignored_invalid += 1
            continue


        # ----------------------------------------------------
        # Presque parallèles :
        # ce n'est pas une jonction L/T/X.
        # ----------------------------------------------------

        angle = acute_angle_deg(
            da["dir"],
            db["dir"]
        )


        if angle <= angle_tol_deg:

            ignored_parallel += 1
            continue


        # ----------------------------------------------------
        # Intersection des supports
        # ----------------------------------------------------

        intersection = support_intersection(
            da,
            db
        )


        if intersection is None:

            ignored_parallel += 1
            continue


        point = intersection["point"]


        # ----------------------------------------------------
        # Position par rapport aux deux segments
        # ----------------------------------------------------

        pos_a = classify_on_segment(
            da,
            point
        )

        pos_b = classify_on_segment(
            db,
            point
        )


        type_a = pos_a["type"]
        type_b = pos_b["type"]


        # ====================================================
        # L
        #
        # endpoint + endpoint
        # ====================================================

        if (
            type_a == "endpoint"
            and
            type_b == "endpoint"
        ):

            junction_type = "L"


        # ====================================================
        # T
        #
        # endpoint + interior
        # ou
        # interior + endpoint
        # ====================================================

        elif (

            (
                type_a == "endpoint"
                and
                type_b == "interior"
            )

            or

            (
                type_a == "interior"
                and
                type_b == "endpoint"
            )
        ):

            junction_type = "T"


        # ====================================================
        # X
        #
        # interior + interior
        # ====================================================

        elif (
            type_a == "interior"
            and
            type_b == "interior"
        ):

            junction_type = "X"


        else:

            # Au moins une intersection est trop éloignée
            # du segment concerné.
            ignored_far += 1
            continue


        junctions.append({

            "type":
                junction_type,

            "a":
                i,

            "b":
                j,

            "point":
                point,

            "pos_a":
                pos_a,

            "pos_b":
                pos_b,

            "angle_deg":
                angle
        })


# ============================================================
# PROBLEME POTENTIEL :
#
# Une même extrémité peut participer à plusieurs jonctions.
#
# Exemple :
#
#                 B
#                 |
#       A --------●
#                 |
#                 C
#
# On ne doit pas déplacer la même extrémité vers deux
# positions différentes.
#
#
# Nous collectons donc toutes les propositions de correction
# par (axe, endpoint).
# ============================================================

endpoint_proposals = {}


def add_endpoint_proposal(
    record_index,
    endpoint_id,
    point,
    junction_index
):

    key = (
        record_index,
        endpoint_id
    )


    if key not in endpoint_proposals:

        endpoint_proposals[key] = []


    endpoint_proposals[key].append({

        "point":
            point,

        "junction_index":
            junction_index
    })


# ============================================================
# COLLECTER LES CORRECTIONS
# ============================================================

for junction_index, junction in enumerate(
    junctions
):

    # --------------------------------------------------------
    # A
    # --------------------------------------------------------

    if (
        junction["pos_a"]["type"]
        ==
        "endpoint"
    ):

        add_endpoint_proposal(

            junction["a"],

            junction[
                "pos_a"
            ][
                "endpoint_id"
            ],

            junction["point"],

            junction_index
        )


    # --------------------------------------------------------
    # B
    # --------------------------------------------------------

    if (
        junction["pos_b"]["type"]
        ==
        "endpoint"
    ):

        add_endpoint_proposal(

            junction["b"],

            junction[
                "pos_b"
            ][
                "endpoint_id"
            ],

            junction["point"],

            junction_index
        )


# ============================================================
# RESOLUTION DES PROPOSITIONS MULTIPLES
#
# Si plusieurs intersections proposent quasiment le même
# point, on prend leur moyenne.
#
# Si elles sont réellement différentes, on ne déplace PAS
# automatiquement l'extrémité : cas ambigu.
#
# Seuil utilisé :
#
# toutes les propositions doivent être dans un rayon
# <= tolérance jonction.
# ============================================================

resolved_endpoint_targets = {}

ambiguous_endpoints = []

multiple_same_target = 0


for key, proposals in endpoint_proposals.items():

    if len(proposals) == 1:

        resolved_endpoint_targets[key] = (
            proposals[0]["point"]
        )

        continue


    # --------------------------------------------------------
    # Centre moyen
    # --------------------------------------------------------

    cx = sum(
        p["point"][0]
        for p in proposals
    ) / float(len(proposals))

    cy = sum(
        p["point"][1]
        for p in proposals
    ) / float(len(proposals))

    cz = sum(
        p["point"][2]
        for p in proposals
    ) / float(len(proposals))


    center = (
        cx,
        cy,
        cz
    )


    max_distance = max(

        distance2d(
            p["point"],
            center
        )

        for p in proposals
    )


    if max_distance <= junction_tol:

        resolved_endpoint_targets[key] = (
            center
        )

        multiple_same_target += 1


    else:

        ambiguous_endpoints.append({

            "AxeIndex":
                records[
                    key[0]
                ]["index"],

            "Extremite":
                key[1],

            "NbPropositions":
                len(proposals),

            "EcartMax_mm":
                round(
                    project_to_mm(
                        max_distance
                    ),
                    1
                )
        })


# ============================================================
# APPLIQUER LES CORRECTIONS
# ============================================================

corrections_geometry = []

corrections_count = 0


for record_index, record in enumerate(
    records
):

    original_p0 = record["p0"]
    original_p1 = record["p1"]

    new_p0 = original_p0
    new_p1 = original_p1


    # --------------------------------------------------------
    # Endpoint 0
    # --------------------------------------------------------

    key0 = (
        record_index,
        0
    )


    if key0 in resolved_endpoint_targets:

        target = (
            resolved_endpoint_targets[
                key0
            ]
        )


        displacement = distance2d(
            original_p0,
            target
        )


        if displacement > EPS:

            new_p0 = target

            record["modified"] = True

            record["corrections"].append({

                "Endpoint":
                    0,

                "Distance_mm":
                    round(
                        project_to_mm(
                            displacement
                        ),
                        1
                    )
            })


            correction_line = make_line(
                original_p0,
                target
            )


            if correction_line is not None:

                corrections_geometry.append(
                    correction_line
                )


            corrections_count += 1


    # --------------------------------------------------------
    # Endpoint 1
    # --------------------------------------------------------

    key1 = (
        record_index,
        1
    )


    if key1 in resolved_endpoint_targets:

        target = (
            resolved_endpoint_targets[
                key1
            ]
        )


        displacement = distance2d(
            original_p1,
            target
        )


        if displacement > EPS:

            new_p1 = target

            record["modified"] = True

            record["corrections"].append({

                "Endpoint":
                    1,

                "Distance_mm":
                    round(
                        project_to_mm(
                            displacement
                        ),
                        1
                    )
            })


            correction_line = make_line(
                original_p1,
                target
            )


            if correction_line is not None:

                corrections_geometry.append(
                    correction_line
                )


            corrections_count += 1


    # --------------------------------------------------------
    # Reconstruire l'axe
    # --------------------------------------------------------

    new_curve = make_line(
        new_p0,
        new_p1
    )


    if new_curve is not None:

        record["curve"] = new_curve
        record["p0"] = new_p0
        record["p1"] = new_p1


# ============================================================
# POINTS DE CONTROLE L / T / X
# ============================================================

junction_points_L = []
junction_points_T = []
junction_points_X = []


for junction in junctions:

    point = make_point(
        junction["point"]
    )


    if point is None:
        continue


    if junction["type"] == "L":

        junction_points_L.append(
            point
        )


    elif junction["type"] == "T":

        junction_points_T.append(
            point
        )


    elif junction["type"] == "X":

        junction_points_X.append(
            point
        )


# ============================================================
# AXES FINAUX
# ============================================================

final_axes = []
final_widths = []


for record in records:

    final_axes.append(
        record["curve"]
    )

    final_widths.append(
        record["width_mm"]
    )


# ============================================================
# INFORMATIONS JONCTIONS
# ============================================================

junction_infos = []


for i, junction in enumerate(
    junctions
):

    rec_a = records[
        junction["a"]
    ]

    rec_b = records[
        junction["b"]
    ]


    info = {

        "Index":
            i,

        "Type":
            junction["type"],

        "AxeA":
            rec_a["index"],

        "AxeB":
            rec_b["index"],

        "Angle_deg":
            round(
                junction["angle_deg"],
                2
            ),

        "PositionA":
            junction[
                "pos_a"
            ][
                "type"
            ],

        "PositionB":
            junction[
                "pos_b"
            ][
                "type"
            ],

        "DistanceExtremiteA_mm":
            (
                round(
                    project_to_mm(
                        junction[
                            "pos_a"
                        ][
                            "distance"
                        ]
                    ),
                    1
                )

                if
                junction[
                    "pos_a"
                ][
                    "type"
                ]
                ==
                "endpoint"

                else
                None
            ),

        "DistanceExtremiteB_mm":
            (
                round(
                    project_to_mm(
                        junction[
                            "pos_b"
                        ][
                            "distance"
                        ]
                    ),
                    1
                )

                if
                junction[
                    "pos_b"
                ][
                    "type"
                ]
                ==
                "endpoint"

                else
                None
            )
    }


    junction_infos.append(
        info
    )


# ============================================================
# DIAGNOSTIC
# ============================================================

modified_axes_count = sum(

    1

    for record in records

    if record["modified"]
)


diagnostic = {

    "Axes entree":
        len(axes),

    "Axes valides":
        len(records),

    "Tests de paires":
        pair_tests,

    "Jonctions detectees":
        len(junctions),

    "Jonctions L":
        len(junction_points_L),

    "Jonctions T":
        len(junction_points_T),

    "Jonctions X":
        len(junction_points_X),

    "Corrections extremites":
        corrections_count,

    "Axes modifies":
        modified_axes_count,

    "Extremites avec plusieurs propositions compatibles":
        multiple_same_target,

    "Extremites ambigues non corrigees":
        len(ambiguous_endpoints),

    "Paires paralleles ignorees":
        ignored_parallel,

    "Intersections hors tolerance ignorees":
        ignored_far,

    "Paires invalides":
        ignored_invalid,

    "Tolerance jonction mm":
        junction_tol_mm,

    "Tolerance angle deg":
        angle_tol_deg,

    "Axes finaux":
        len(final_axes)
}


# Ajouter les détails des ambiguïtés
# directement au diagnostic pour inspection.

diagnostic[
    "Details extremites ambigues"
] = ambiguous_endpoints


# ============================================================
# OUTPUT
# ============================================================

OUT = (

    final_axes,              # OUT[0]

    final_widths,            # OUT[1]

    junction_points_L,       # OUT[2]

    junction_points_T,       # OUT[3]

    junction_points_X,       # OUT[4]

    corrections_geometry,    # OUT[5]

    junction_infos,          # OUT[6]

    diagnostic               # OUT[7]
)
# ----------------------------------------
code_block_11 = CodeBlock(x=MUR_06_ResoudreJonctions) { x[0]; x[1]; }
MUR_07_ClasserEpaisseurs = Python(IN[0]=code_block_11.out0, IN[1]=code_block_11.out1)  # PythonNet3; unwired: IN[2]
# ---------- MUR_07_ClasserEpaisseurs.python (637 lines) ----------
# -*- coding: utf-8 -*-

import math


# ============================================================
# MUR_07_ClasserEpaisseurs
#
# Objectif :
#
# A partir des épaisseurs mesurées sur les axes MUR_06 :
#
#   99.9999999998
#   100.0000000003
#   119.867756
#   30.000000001
#   79.999999999
#
# produire des classes propres :
#
#   100
#   100
#   120
#   30
#   80
#
#
# IMPORTANT :
#
# On ne force PAS les épaisseurs sur un pas de 10 mm.
#
# Exemple :
#
#   71.8
#   72.0
#   72.2
#
# devient :
#
#   72 mm
#
# et non 70 mm.
#
# ============================================================


# ============================================================
# INPUTS
# ============================================================

input_axes = IN[0] if IN[0] else []
input_widths = IN[1] if IN[1] else []

cluster_tol_mm = (
    float(IN[2])
    if IN[2] is not None
    else 2.0
)


# ============================================================
# OUTILS
# ============================================================

def flatten(data):

    result = []

    if isinstance(data, (list, tuple)):

        for item in data:
            result.extend(
                flatten(item)
            )

    elif data is not None:

        result.append(data)

    return result


axes = flatten(input_axes)
widths_raw = flatten(input_widths)


def safe_float(value):

    try:

        x = float(value)

        if math.isnan(x):
            return None

        if math.isinf(x):
            return None

        return x

    except:

        return None


def clean_number(value):

    """
    Nettoyage uniquement pour affichage.

    100.00000000003 -> 100
    119.8677         -> 119.868
    """

    if value is None:
        return None

    rounded_integer = round(value)

    if abs(
        value - rounded_integer
    ) < 1e-6:

        return int(
            rounded_integer
        )

    return round(
        value,
        3
    )


# ============================================================
# VERIFICATION DES DONNEES
# ============================================================

valid_items = []

invalid_width_indices = []


count = min(
    len(axes),
    len(widths_raw)
)


for i in range(count):

    width = safe_float(
        widths_raw[i]
    )


    if width is None:

        invalid_width_indices.append(
            i
        )

        continue


    if width <= 0.0:

        invalid_width_indices.append(
            i
        )

        continue


    valid_items.append({

        "index":
            i,

        "axis":
            axes[i],

        "width":
            width
    })


# ============================================================
# TRI PAR EPAISSEUR
# ============================================================

sorted_items = sorted(

    valid_items,

    key=lambda x:
        x["width"]
)


# ============================================================
# CREATION DES GROUPES
#
# Méthode :
#
# On ajoute une valeur au groupe courant si elle reste
# compatible avec le centre du groupe.
#
# Le centre est recalculé après chaque ajout.
#
# Exemple tolérance 2 mm :
#
# 99.8
# 100.0
# 100.3
#
# => même groupe
#
#
# 100
# 104
#
# => deux groupes
#
# ============================================================

clusters = []


for item in sorted_items:

    width = item["width"]


    if not clusters:

        clusters.append({

            "items":
                [item],

            "mean":
                width
        })

        continue


    current = clusters[-1]


    if abs(
        width -
        current["mean"]
    ) <= cluster_tol_mm:

        current["items"].append(
            item
        )


        current["mean"] = (

            sum(
                x["width"]
                for x in current["items"]
            )

            /
            float(
                len(current["items"])
            )
        )


    else:

        clusters.append({

            "items":
                [item],

            "mean":
                width
        })


# ============================================================
# CLASSE REPRESENTATIVE
#
# Pour chaque cluster :
#
#   moyenne mesurée = 99.9987
#
# classe :
#
#   100 mm
#
#
# Ici on arrondit la moyenne au millimètre.
#
# Ce n'est PAS un arrondi au multiple de 10.
#
# 72.1 -> 72
# 97.2 -> 97
# 119.87 -> 120
# ============================================================

for cluster in clusters:

    mean_width = cluster["mean"]

    class_width = float(
        round(mean_width)
    )


    cluster["class_width"] = (
        class_width
    )


# ============================================================
# ATTENTION :
#
# Deux clusters différents pourraient exceptionnellement
# produire la même classe après arrondi.
#
# Exemple :
#
# cluster A -> 99.4 -> 99
# cluster B -> 99.49 -> 99
#
# On consolide donc les classes identiques.
# ============================================================

class_map = {}


for cluster in clusters:

    class_width = (
        cluster["class_width"]
    )


    if class_width not in class_map:

        class_map[class_width] = {

            "class_width":
                class_width,

            "items":
                []
        }


    class_map[
        class_width
    ]["items"].extend(
        cluster["items"]
    )


# ============================================================
# CLASSES FINALES
# ============================================================

final_classes = sorted(
    class_map.values(),
    key=lambda x:
        x["class_width"]
)


# ============================================================
# TABLE INDEX ORIGINAL -> CLASSE
# ============================================================

classified_by_index = {}


for class_data in final_classes:

    class_width = (
        class_data["class_width"]
    )


    for item in class_data["items"]:

        classified_by_index[
            item["index"]
        ] = class_width


# ============================================================
# OUTPUT AXES / EPAISSEURS
#
# On conserve exactement l'ordre des axes MUR_06.
# ============================================================

output_axes = []

classified_widths = []

correspondences = []


for i in range(count):

    width = safe_float(
        widths_raw[i]
    )


    if (
        width is None
        or
        i not in classified_by_index
    ):

        continue


    class_width = (
        classified_by_index[i]
    )


    output_axes.append(
        axes[i]
    )

    classified_widths.append(
        class_width
    )


    correspondences.append({

        "AxeIndex":
            i,

        "EpaisseurMesuree_mm":
            clean_number(
                width
            ),

        "EpaisseurClasse_mm":
            clean_number(
                class_width
            ),

        "Correction_mm":
            round(
                class_width -
                width,
                3
            )
    })


# ============================================================
# CLASSES + EFFECTIFS
# ============================================================

detected_classes = []

counts_per_class = []


for class_data in final_classes:

    class_width = (
        class_data["class_width"]
    )

    items = (
        class_data["items"]
    )


    detected_classes.append(
        clean_number(
            class_width
        )
    )


    counts_per_class.append({

        "Epaisseur_mm":
            clean_number(
                class_width
            ),

        "NombreAxes":
            len(items),

        "MinimumMesure_mm":
            clean_number(
                min(
                    x["width"]
                    for x in items
                )
            ),

        "MaximumMesure_mm":
            clean_number(
                max(
                    x["width"]
                    for x in items
                )
            ),

        "MoyenneMesuree_mm":
            clean_number(

                sum(
                    x["width"]
                    for x in items
                )

                /
                float(
                    len(items)
                )
            )
    })


# ============================================================
# STATISTIQUES DE CORRECTION
# ============================================================

corrections = []


for item in correspondences:

    corrections.append(
        abs(
            item["Correction_mm"]
        )
    )


if corrections:

    max_correction = max(
        corrections
    )

    mean_correction = (
        sum(corrections)
        /
        float(len(corrections))
    )

else:

    max_correction = 0.0
    mean_correction = 0.0


# ============================================================
# DIAGNOSTIC
# ============================================================

diagnostic = {

    "Axes entree":
        len(axes),

    "Epaisseurs entree":
        len(widths_raw),

    "Axes analyses":
        count,

    "Epaisseurs valides":
        len(valid_items),

    "Epaisseurs invalides":
        len(invalid_width_indices),

    "Indices epaisseurs invalides":
        invalid_width_indices,

    "Clusters initiaux":
        len(clusters),

    "Classes finales":
        len(final_classes),

    "Classes detectees mm":
        detected_classes,

    "Tolerance regroupement mm":
        cluster_tol_mm,

    "Correction moyenne mm":
        round(
            mean_correction,
            3
        ),

    "Correction maximum mm":
        round(
            max_correction,
            3
        ),

    "Axes sortie":
        len(output_axes)
}


# ============================================================
# OUTPUT
# ============================================================

OUT = (

    output_axes,            # OUT[0]

    classified_widths,      # OUT[1]

    detected_classes,       # OUT[2]

    counts_per_class,       # OUT[3]

    correspondences,        # OUT[4]

    diagnostic              # OUT[5]
)
# ----------------------------------------
code_block_12 = CodeBlock(x=MUR_07_ClasserEpaisseurs) { x[0]; x[1]; x[3]; }
MUR_08_CreerTypesMurs = Python(IN[0]=code_block_12.out1, IN[1]=n5_wall_types)  # PythonNet3; unwired: IN[2]
# ---------- MUR_08_CreerTypesMurs.python (769 lines) ----------
# -*- coding: utf-8 -*-

import clr
import math

# ============================================================
# REVIT API
# ============================================================

clr.AddReference("RevitAPI")

from Autodesk.Revit.DB import (
    WallType,
    FilteredElementCollector,
    UnitUtils,
    UnitTypeId
)


# ============================================================
# REVIT SERVICES
# ============================================================

clr.AddReference("RevitServices")

from RevitServices.Persistence import DocumentManager
from RevitServices.Transactions import TransactionManager


# ============================================================
# MUR_08_CreerTypesMurs
#
# IN[0]
#     Epaisseurs classifiees de MUR_07
#
# IN[1]
#     WallType modele
#
# IN[2]
#     Prefixe
#
#
# Exemple :
#
# Epaisseurs :
#
#   30
#   70
#   100
#   120
#
# Type modele :
#
#   Mur generique
#
# Resultat :
#
#   A SUPPRIMER_CHU_Mur_30mm
#   A SUPPRIMER_CHU_Mur_70mm
#   A SUPPRIMER_CHU_Mur_100mm
#   A SUPPRIMER_CHU_Mur_120mm
#
#
# Si le type existe deja :
#
#   => reutilisation
#
# Si le type n'existe pas :
#
#   => duplication du type modele
#   => modification largeur couche
#
# ============================================================


# ============================================================
# DOCUMENT
# ============================================================

doc = DocumentManager.Instance.CurrentDBDocument


# ============================================================
# INPUTS
# ============================================================

input_widths = IN[0] if IN[0] else []

base_wall_type = IN[1]

prefix = IN[2] if len(IN) > 2 else None


if prefix is None:

    prefix = "A SUPPRIMER_"


try:

    prefix = str(prefix)

except:

    prefix = "A SUPPRIMER_"


if prefix.strip() == "":

    prefix = "A SUPPRIMER_"


# ============================================================
# UNWRAP
# ============================================================

try:

    base_wall_type = UnwrapElement(
        base_wall_type
    )

except:

    pass


# ============================================================
# OUTILS
# ============================================================

def flatten(data):

    result = []

    if isinstance(data, (list, tuple)):

        for item in data:

            result.extend(
                flatten(item)
            )

    elif data is not None:

        result.append(data)

    return result


def safe_float(value):

    try:

        result = float(value)

        if math.isnan(result):
            return None

        if math.isinf(result):
            return None

        return result

    except:

        return None


def format_width(width_mm):

    """
    100.0 -> 100
    72.0  -> 72
    72.5  -> 72.5
    """

    rounded = round(
        width_mm
    )


    if abs(
        width_mm -
        rounded
    ) < 1e-6:

        return str(
            int(rounded)
        )


    text = (
        "{:.3f}".format(
            width_mm
        )
        .rstrip("0")
        .rstrip(".")
    )

    return text


def make_type_name(width_mm):

    return (
        prefix
        +
        format_width(width_mm)
        +
        "mm"
    )


def mm_to_internal(width_mm):

    return UnitUtils.ConvertToInternalUnits(
        width_mm,
        UnitTypeId.Millimeters
    )


# ============================================================
# EPAISSEURS
# ============================================================

widths_raw = flatten(
    input_widths
)

widths = []

invalid_width_indices = []


for i, value in enumerate(
    widths_raw
):

    width = safe_float(
        value
    )


    if (
        width is None
        or
        width <= 0.0
    ):

        widths.append(
            None
        )

        invalid_width_indices.append(
            i
        )

    else:

        widths.append(
            width
        )


# ============================================================
# VERIFICATION DU TYPE MODELE
# ============================================================

fatal_error = None


if base_wall_type is None:

    fatal_error = (
        "Aucun WallType modele fourni."
    )


elif not isinstance(
    base_wall_type,
    WallType
):

    fatal_error = (
        "IN[1] doit etre un WallType Revit."
    )


# ============================================================
# COLLECTER LES WALLTYPES EXISTANTS
# ============================================================

existing_types_by_name = {}


if fatal_error is None:

    collector = (
        FilteredElementCollector(doc)
        .OfClass(WallType)
    )


    for wall_type in collector:

        try:

            name = wall_type.Name

            existing_types_by_name[
                name
            ] = wall_type

        except:

            pass


# ============================================================
# CLASSES UNIQUES
# ============================================================

unique_widths = sorted(
    set(
        width
        for width in widths
        if width is not None
    )
)


# ============================================================
# OUTPUTS
# ============================================================

types_by_width = {}

created_types = []

reused_types = []

correspondences = []

errors = []


# ============================================================
# CREATION / REUTILISATION
# ============================================================

if fatal_error is None:

    TransactionManager.Instance.EnsureInTransaction(
        doc
    )


    try:

        for width_mm in unique_widths:

            type_name = make_type_name(
                width_mm
            )


            # =================================================
            # CAS 1
            # LE TYPE EXISTE DEJA
            # =================================================

            if type_name in existing_types_by_name:

                wall_type = (
                    existing_types_by_name[
                        type_name
                    ]
                )


                types_by_width[
                    width_mm
                ] = wall_type


                reused_types.append(
                    wall_type
                )


                correspondences.append({

                    "Epaisseur_mm":
                        width_mm,

                    "NomType":
                        type_name,

                    "Action":
                        "Reutilise",

                    "ElementId":
                        wall_type.Id.Value
                })


                continue


            # =================================================
            # CAS 2
            # CREATION
            # =================================================

            try:

                # ---------------------------------------------
                # Dupliquer le type modele
                # ---------------------------------------------

                new_type = (
                    base_wall_type.Duplicate(
                        type_name
                    )
                )


                # ---------------------------------------------
                # CompoundStructure
                # ---------------------------------------------

                compound = (
                    new_type.GetCompoundStructure()
                )


                if compound is None:

                    errors.append({

                        "Epaisseur_mm":
                            width_mm,

                        "NomType":
                            type_name,

                        "Erreur":
                            "Le WallType ne possede pas de CompoundStructure."
                    })

                    continue


                # ---------------------------------------------
                # Vérifier le nombre de couches
                # ---------------------------------------------

                layers = compound.GetLayers()

                layer_count = len(layers)


                if layer_count != 1:

                    errors.append({

                        "Epaisseur_mm":
                            width_mm,

                        "NomType":
                            type_name,

                        "Erreur":
                            (
                                "Le type modele contient "
                                +
                                str(layer_count)
                                +
                                " couches. MUR_08 attend actuellement "
                                +
                                "un mur simple a une seule couche."
                            )
                    })

                    continue


                # ---------------------------------------------
                # Nouvelle largeur
                # ---------------------------------------------

                width_internal = (
                    mm_to_internal(
                        width_mm
                    )
                )


                compound.SetLayerWidth(
                    0,
                    width_internal
                )


                # ---------------------------------------------
                # Réaffecter la CompoundStructure
                # ---------------------------------------------

                new_type.SetCompoundStructure(
                    compound
                )


                # ---------------------------------------------
                # Stockage
                # ---------------------------------------------

                types_by_width[
                    width_mm
                ] = new_type


                created_types.append(
                    new_type
                )


                existing_types_by_name[
                    type_name
                ] = new_type


                correspondences.append({

                    "Epaisseur_mm":
                        width_mm,

                    "NomType":
                        type_name,

                    "Action":
                        "Cree",

                    "ElementId":
                        new_type.Id.Value
                })


            except Exception as ex:

                errors.append({

                    "Epaisseur_mm":
                        width_mm,

                    "NomType":
                        type_name,

                    "Erreur":
                        str(ex)
                })


    finally:

        TransactionManager.Instance.TransactionTaskDone()


# ============================================================
# TYPE POUR CHAQUE AXE
#
# L'ordre est strictement celui de MUR_07 OUT[1].
#
# Exemple :
#
# widths :
#
# [100, 100, 70, 30, 100]
#
# OUT[0] :
#
# [Type100,
#  Type100,
#  Type70,
#  Type30,
#  Type100]
#
# ============================================================

wall_types_per_axis = []


for width in widths:

    if width is None:

        wall_types_per_axis.append(
            None
        )

        continue


    wall_type = types_by_width.get(
        width
    )


    wall_types_per_axis.append(
        wall_type
    )


# ============================================================
# TYPES UNIQUES
# ============================================================

unique_wall_types = []


for width in unique_widths:

    wall_type = types_by_width.get(
        width
    )

    if wall_type is not None:

        unique_wall_types.append(
            wall_type
        )


# ============================================================
# VERIFICATION LARGEUR REELLE
# ============================================================

width_checks = []


for width in unique_widths:

    wall_type = types_by_width.get(
        width
    )


    if wall_type is None:
        continue


    actual_width_mm = None


    try:

        actual_width_mm = (
            UnitUtils.ConvertFromInternalUnits(
                wall_type.Width,
                UnitTypeId.Millimeters
            )
        )

    except:

        pass


    width_checks.append({

        "NomType":
            wall_type.Name,

        "EpaisseurDemandee_mm":
            width,

        "EpaisseurRevit_mm":
            (
                round(
                    actual_width_mm,
                    3
                )
                if
                actual_width_mm
                is not None
                else None
            )
    })


# ============================================================
# DIAGNOSTIC
# ============================================================

diagnostic = {

    "Epaisseurs entree":
        len(widths_raw),

    "Epaisseurs valides":
        len([
            x
            for x in widths
            if x is not None
        ]),

    "Epaisseurs invalides":
        len(
            invalid_width_indices
        ),

    "Indices invalides":
        invalid_width_indices,

    "Classes demandees":
        len(unique_widths),

    "Types disponibles":
        len(unique_wall_types),

    "Types crees":
        len(created_types),

    "Types existants reutilises":
        len(reused_types),

    "Erreurs":
        len(errors),

    "Details erreurs":
        errors,

    "Prefixe":
        prefix,

    "Verification largeurs":
        width_checks,

    "Types par axe":
        len(wall_types_per_axis)
}


if fatal_error is not None:

    diagnostic[
        "Erreur fatale"
    ] = fatal_error


# ============================================================
# OUTPUT
# ============================================================

OUT = (

    wall_types_per_axis,     # OUT[0]

    unique_wall_types,       # OUT[1]

    created_types,           # OUT[2]

    reused_types,            # OUT[3]

    correspondences,         # OUT[4]

    diagnostic               # OUT[5]
)
# ----------------------------------------
code_block_13 = CodeBlock(x=MUR_08_CreerTypesMurs) { x[0]; x[1]; x[5]; }
MUR_09_CreerMursRevit = Python(IN[0]=code_block_12.out0, IN[1]=code_block_13.out0, IN[2]=n6_niveau_bas, IN[3]=n7_niveau_haut)  # PythonNet3; unwired: IN[4], IN[5]
# ---------- MUR_09_CreerMursRevit.python (1082 lines) ----------
# -*- coding: utf-8 -*-

import clr
import math


# ============================================================
# DESIGN SCRIPT
# ============================================================

clr.AddReference("ProtoGeometry")

from Autodesk.DesignScript.Geometry import (
    Line as DSLine
)


# ============================================================
# REVIT API
# ============================================================

clr.AddReference("RevitAPI")

from Autodesk.Revit.DB import (
    Curve,
    Line,
    Wall,
    WallType,
    Level,
    UnitUtils,
    UnitTypeId,
    BuiltInParameter
)


# ============================================================
# DYNAMO <-> REVIT CONVERSION
# ============================================================

clr.AddReference("RevitNodes")

import Revit

clr.ImportExtensions(
    Revit.GeometryConversion
)

clr.ImportExtensions(
    Revit.Elements
)


# ============================================================
# REVIT SERVICES
# ============================================================

clr.AddReference("RevitServices")

from RevitServices.Persistence import (
    DocumentManager
)

from RevitServices.Transactions import (
    TransactionManager
)


# ============================================================
# MUR_09_CreerMursRevit
#
# IN[0] = Axes MUR_07
# IN[1] = WallTypes MUR_08
# IN[2] = Niveau bas
# IN[3] = Niveau haut
# IN[4] = Decalage bas mm
# IN[5] = Decalage haut mm
#
#
# OUT[0] = MursCrees
# OUT[1] = AxesCrees
# OUT[2] = IndicesCrees
# OUT[3] = AxesIgnores
# OUT[4] = Erreurs
# OUT[5] = Informations
# OUT[6] = Diagnostic
#
# ============================================================


# ============================================================
# DOCUMENT
# ============================================================

doc = (
    DocumentManager
    .Instance
    .CurrentDBDocument
)


# ============================================================
# INPUTS
# ============================================================

input_axes = (
    IN[0]
    if IN[0]
    else []
)

input_wall_types = (
    IN[1]
    if IN[1]
    else []
)

base_level = IN[2]
top_level = IN[3]


bottom_offset_mm = (

    float(IN[4])

    if (
        len(IN) > 4
        and
        IN[4] is not None
    )

    else 0.0
)


top_offset_mm = (

    float(IN[5])

    if (
        len(IN) > 5
        and
        IN[5] is not None
    )

    else 0.0
)


# ============================================================
# UNWRAP LEVELS
# ============================================================

try:

    base_level = UnwrapElement(
        base_level
    )

except:

    pass


try:

    top_level = UnwrapElement(
        top_level
    )

except:

    pass


# ============================================================
# AXES
#
# Les axes peuvent éventuellement arriver dans une liste
# imbriquée. Ici on peut les flatten.
# ============================================================

def flatten(data):

    result = []

    if isinstance(
        data,
        (list, tuple)
    ):

        for item in data:

            result.extend(
                flatten(item)
            )

    elif data is not None:

        result.append(
            data
        )

    return result


axes = flatten(
    input_axes
)


# ============================================================
# WALLTYPES
#
# IMPORTANT :
#
# NE PAS utiliser flatten() ici.
#
# Il faut absolument conserver :
#
# Axe 46 -> WallType 46
# Axe 47 -> None
# Axe 48 -> WallType 48
#
# Sinon l'alignement axes/types serait détruit.
# ============================================================

if isinstance(
    input_wall_types,
    (list, tuple)
):

    wall_types_raw = list(
        input_wall_types
    )

else:

    wall_types_raw = [
        input_wall_types
    ]


wall_types = []


for item in wall_types_raw:

    if item is None:

        wall_types.append(
            None
        )

        continue


    try:

        item = UnwrapElement(
            item
        )

    except:

        pass


    wall_types.append(
        item
    )


# ============================================================
# UNITES
# ============================================================

def mm_to_internal(value_mm):

    return (
        UnitUtils
        .ConvertToInternalUnits(
            float(value_mm),
            UnitTypeId.Millimeters
        )
    )


def internal_to_mm(value):

    return (
        UnitUtils
        .ConvertFromInternalUnits(
            value,
            UnitTypeId.Millimeters
        )
    )


bottom_offset = mm_to_internal(
    bottom_offset_mm
)

top_offset = mm_to_internal(
    top_offset_mm
)


# ============================================================
# ELEMENT ID
# ============================================================

def get_element_id_value(element):

    if element is None:
        return None


    try:

        return element.Id.Value

    except:

        try:

            return (
                element
                .Id
                .IntegerValue
            )

        except:

            return None


# ============================================================
# CONVERSION DYNAMO -> REVIT
#
# IMPORTANT :
#
# Ici on utilise directement la couche de conversion
# Dynamo/Revit.
#
# Autodesk.DesignScript.Geometry.Line
#
#              ↓
#
#         ToRevitType()
#
#              ↓
#
# Autodesk.Revit.DB.Line
#
#
# On retourne également le détail de l'erreur afin de ne
# jamais masquer une erreur CPython.
# ============================================================

def dynamo_curve_to_revit_curve(
    dynamo_curve
):

    if dynamo_curve is None:

        return (
            None,
            "Curve = None"
        )


    # --------------------------------------------------------
    # Cas exceptionnel :
    # l'entrée serait déjà une Curve Revit
    # --------------------------------------------------------

    try:

        if isinstance(
            dynamo_curve,
            Curve
        ):

            return (
                dynamo_curve,
                None
            )

    except:

        pass


    # --------------------------------------------------------
    # Conversion Dynamo native
    # --------------------------------------------------------

    try:

        revit_curve = (
            dynamo_curve
            .ToRevitType()
        )


        if revit_curve is None:

            return (
                None,
                "ToRevitType() retourne None"
            )


        if not isinstance(
            revit_curve,
            Curve
        ):

            return (

                None,

                (
                    "ToRevitType() a retourne "
                    "un objet qui n'est pas "
                    "Autodesk.Revit.DB.Curve : "
                    +
                    str(
                        type(
                            revit_curve
                        )
                    )
                )
            )


        return (
            revit_curve,
            None
        )


    except Exception as ex:

        return (

            None,

            (
                "Erreur ToRevitType : "
                +
                str(ex)
            )
        )


# ============================================================
# VALIDATION GENERALE
# ============================================================

fatal_errors = []


if not isinstance(
    base_level,
    Level
):

    fatal_errors.append(
        "IN[2] doit etre un Level Revit."
    )


if not isinstance(
    top_level,
    Level
):

    fatal_errors.append(
        "IN[3] doit etre un Level Revit."
    )


if len(axes) == 0:

    fatal_errors.append(
        "Aucun axe recu dans IN[0]."
    )


if len(wall_types) == 0:

    fatal_errors.append(
        "Aucun WallType recu dans IN[1]."
    )


# ============================================================
# HAUTEUR
#
# La hauteur géométrique entre :
#
# NiveauBas + offsetBas
#
# et
#
# NiveauHaut + offsetHaut
# ============================================================

wall_height = None


if (
    isinstance(base_level, Level)
    and
    isinstance(top_level, Level)
):

    wall_height = (

        top_level.Elevation
        +
        top_offset

        -

        (
            base_level.Elevation
            +
            bottom_offset
        )
    )


    if wall_height <= 0.0:

        fatal_errors.append(

            "Hauteur de mur <= 0. "
            "Verifier Niveau Bas, Niveau Haut "
            "et les offsets."
        )


# ============================================================
# OUTPUTS
# ============================================================

created_walls = []

created_axes = []

created_indices = []

ignored_axes = []

errors = []

informations = []


conversion_success = 0
conversion_failure = 0

null_walltypes = 0

creation_success = 0
creation_failure = 0


# ============================================================
# TRANSACTION
# ============================================================

if len(fatal_errors) == 0:

    TransactionManager.Instance.EnsureInTransaction(
        doc
    )


    try:

        # ====================================================
        # BOUCLE AXES
        # ====================================================

        for i, axis in enumerate(
            axes
        ):

            # =================================================
            # WALLTYPE
            # =================================================

            if i >= len(
                wall_types
            ):

                ignored_axes.append(
                    axis
                )


                errors.append({

                    "AxeIndex":
                        i,

                    "Etape":
                        "WallType",

                    "Erreur":
                        (
                            "Index WallType inexistant. "
                            "Nombre de WallTypes = "
                            +
                            str(
                                len(
                                    wall_types
                                )
                            )
                        )
                })


                continue


            wall_type = (
                wall_types[i]
            )


            # =================================================
            # WALLTYPE NULL
            #
            # Dans notre cas :
            #
            # index 47
            # épaisseur 0 mm
            # =================================================

            if wall_type is None:

                null_walltypes += 1


                ignored_axes.append(
                    axis
                )


                informations.append({

                    "AxeIndex":
                        i,

                    "Statut":
                        "Ignore",

                    "Raison":
                        "WallType null"
                })


                continue


            # =================================================
            # VALIDATION WALLTYPE
            # =================================================

            if not isinstance(
                wall_type,
                WallType
            ):

                ignored_axes.append(
                    axis
                )


                errors.append({

                    "AxeIndex":
                        i,

                    "Etape":
                        "WallType",

                    "Erreur":
                        (
                            "Objet associe non reconnu "
                            "comme Autodesk.Revit.DB.WallType."
                        ),

                    "TypeObjet":
                        str(
                            type(
                                wall_type
                            )
                        )
                })


                continue


            # =================================================
            # CONVERSION AXE
            # =================================================

            (
                revit_curve,
                conversion_error

            ) = dynamo_curve_to_revit_curve(
                axis
            )


            if revit_curve is None:

                conversion_failure += 1


                ignored_axes.append(
                    axis
                )


                # ---------------------------------------------
                # Type DesignScript pour diagnostic
                # ---------------------------------------------

                try:

                    axis_type = str(
                        axis.GetType()
                    )

                except:

                    axis_type = str(
                        type(axis)
                    )


                errors.append({

                    "AxeIndex":
                        i,

                    "Etape":
                        "Conversion",

                    "Erreur":
                        conversion_error,

                    "TypeAxe":
                        axis_type
                })


                continue


            conversion_success += 1


            # =================================================
            # WALL.CREATE
            #
            # On crée initialement avec une hauteur explicite.
            #
            # Puis on affecte la contrainte supérieure.
            # =================================================

            try:

                wall = Wall.Create(

                    doc,

                    revit_curve,

                    wall_type.Id,

                    base_level.Id,

                    wall_height,

                    bottom_offset,

                    False,  # flip

                    False   # structural
                )


                # =============================================
                # CONTRAINTE SUPERIEURE
                # =============================================

                top_constraint = (
                    wall.get_Parameter(
                        BuiltInParameter.WALL_HEIGHT_TYPE
                    )
                )


                if (
                    top_constraint is not None
                    and
                    not top_constraint.IsReadOnly
                ):

                    top_constraint.Set(
                        top_level.Id
                    )


                # =============================================
                # OFFSET SUPERIEUR
                # =============================================

                top_offset_parameter = (
                    wall.get_Parameter(
                        BuiltInParameter.WALL_TOP_OFFSET
                    )
                )


                if (
                    top_offset_parameter
                    is not None

                    and

                    not
                    top_offset_parameter
                    .IsReadOnly
                ):

                    top_offset_parameter.Set(
                        top_offset
                    )


                # =============================================
                # OFFSET INFERIEUR
                # =============================================

                bottom_offset_parameter = (
                    wall.get_Parameter(
                        BuiltInParameter.WALL_BASE_OFFSET
                    )
                )


                if (
                    bottom_offset_parameter
                    is not None

                    and

                    not
                    bottom_offset_parameter
                    .IsReadOnly
                ):

                    bottom_offset_parameter.Set(
                        bottom_offset
                    )


                # =============================================
                # SUCCESS
                # =============================================

                created_walls.append(
                    wall
                )

                created_axes.append(
                    axis
                )

                created_indices.append(
                    i
                )


                creation_success += 1


                informations.append({

                    "AxeIndex":
                        i,

                    "Statut":
                        "Cree",

                    "WallId":
                        get_element_id_value(
                            wall
                        ),

                    "WallType":
                        wall_type.Name,

                    "WallTypeId":
                        get_element_id_value(
                            wall_type
                        )
                })


            except Exception as ex:

                creation_failure += 1


                ignored_axes.append(
                    axis
                )


                errors.append({

                    "AxeIndex":
                        i,

                    "Etape":
                        "Wall.Create",

                    "Erreur":
                        str(ex),

                    "WallType":
                        wall_type.Name,

                    "WallTypeId":
                        get_element_id_value(
                            wall_type
                        )
                })


    finally:

        TransactionManager.Instance.TransactionTaskDone()


# ============================================================
# HAUTEUR POUR DIAGNOSTIC
# ============================================================

height_mm = None


if wall_height is not None:

    try:

        height_mm = internal_to_mm(
            wall_height
        )

    except:

        pass


# ============================================================
# DIAGNOSTIC
# ============================================================

diagnostic = {

    "Axes entree":
        len(axes),

    "WallTypes entree":
        len(wall_types),

    "Conversions reussies":
        conversion_success,

    "Conversions echouees":
        conversion_failure,

    "WallTypes null":
        null_walltypes,

    "Murs crees":
        len(created_walls),

    "Creations reussies":
        creation_success,

    "Creations echouees":
        creation_failure,

    "Axes ignores":
        len(ignored_axes),

    "Erreurs":
        len(errors),

    "Details erreurs":
        errors,

    "Niveau bas":
        (
            base_level.Name

            if isinstance(
                base_level,
                Level
            )

            else None
        ),

    "Niveau haut":
        (
            top_level.Name

            if isinstance(
                top_level,
                Level
            )

            else None
        ),

    "Decalage bas mm":
        bottom_offset_mm,

    "Decalage haut mm":
        top_offset_mm,

    "Hauteur calculee mm":
        (
            round(
                height_mm,
                2
            )

            if height_mm is not None

            else None
        ),

    "Erreurs fatales":
        fatal_errors
}


# ============================================================
# OUTPUT
# ============================================================

OUT = (

    created_walls,       # OUT[0]

    created_axes,        # OUT[1]

    created_indices,     # OUT[2]

    ignored_axes,        # OUT[3]

    errors,              # OUT[4]

    informations,        # OUT[5]

    diagnostic           # OUT[6]
)
# ----------------------------------------
watch = Watch(MUR_09_CreerMursRevit)  # graph output
